# Grasshopper definition 001_vectors.gh (Grasshopper 1.0.7)
# plug-ins: RhinoCodePluginGH

# 2nd gpt-4 Text Prompt
# Great, now make the script much more complex model
# with complex trigonometric polynomials and the
# NUMPY python library. Be sure to incorporate the previous code logic.
# ensure that this script produces 3d geometry as
# well for Data visualization purposes.
number_slider = Slider(1.85, range=0..10)
# Becoming a Data Scientist
# with Python in Grasshopper
# at Wickerson Studios
# 001 Mathematics
# 001 LINEAR ALGEBRA
# 001 vectors
# gpt-4 Text Prompt
# Create a geometric 3D model with
# 
# Mathematics
# 
# LINEAR ALGEBRA
# 
# vectors
# 
# 
# in python 3 code for the python 3 script
# node in grasshopper for Rhino8WIP using the
# 
# Rhino Common API to create some geometry as well.
# 
# Output the parts of the model in different
# variable outputs in the python 3 node in
# grasshopper.
# BASIC
number_slider_2 = Slider(1.85, range=0..10)  # disabled
number_slider_3 = Slider(2.63, range=0..10)  # disabled
# ADVANCED
number_slider_4 = Slider(1.85, range=0..10)  # disabled
number_slider_5 = Slider(3.27, range=0..10)  # disabled
number_slider_6 = Slider(0.92, range=0..10)  # disabled
number_slider_7 = Slider(1.47, range=0..10)  # disabled
vector_xyz = VectorXYZ(XComponent=number_slider, YComponent=Slider(2.49, range=0..10), ZComponent=Slider(1.44, range=0..10))  # -> Vector, Length
vector_xyz_2 = VectorXYZ(XComponent=number_slider_2, YComponent=number_slider_3, ZComponent=number_slider_4)  # -> Vector, Length; disabled
vectors = Script(
    init_vector=vector_xyz.Vector,
    scaleX=Slider(2.73, range=0..10),
    scaleY=Slider(0, range=0..10),
    scaleZ=Slider(1.27, range=0..10),
    omega=Slider(-1, range=-1..1))  # -> out, a, b; inputs init_vector: Vector3d, scaleX: Double, scaleY: Double, scaleZ: Double, omega: Double
# ---------- vectors: Python ----------
import Rhino.Geometry as rg
import numpy as np

# Parameters:
# init_vector: initial vector provided by the user 
# scaleX, scaleY, scaleZ: scaling factors provided by the user
# omega: frequency of the trigonometric polynomial

def create_line(init_vector, scaleX, scaleY, scaleZ):
    v = init_vector

    transformation_matrix = rg.Transform(0)  # identity matrix
    transformation_matrix.M00 = scaleX  
    transformation_matrix.M11 = scaleY  
    transformation_matrix.M22 = scaleZ  

    transformed_v = v
    transformed_v.Transform(transformation_matrix)

    # Create the line segment using the initial and transformed vectors
    line = rg.Line(rg.Point3d.Origin, rg.Point3d(rg.Point3d.Origin + transformed_v))

    return line

def trigonometric_curve(omega, t_range):
    t = np.linspace(t_range[0], t_range[1], 1000)
    
    x = np.cos(omega * t)
    y = np.sin(omega * t)
    z = np.cos(omega * t) * np.sin(omega * t)
    
    points = [rg.Point3d(x[i], y[i], z[i]) for i in range(len(t))]
    curve = rg.PolylineCurve(points)

    return curve

# Outputs
a = create_line(init_vector, scaleX, scaleY, scaleZ)
b = trigonometric_curve(omega, [0, 2 * np.pi])
# ---------- end vectors ----------
vectors_2 = Script(init_vector=vector_xyz_2.Vector, scaleX=number_slider_5, scaleY=number_slider_6, scaleZ=number_slider_7)  # -> out, a; inputs init_vector: Vector3d, scaleX: Double, scaleY: Double, scaleZ: Double; disabled
# ---------- vectors_2: Python ----------
import Rhino.Geometry as rg
import System

# Parameters:
# init_vector: initial vector provided by the user (e.g., rg.Vector3d(1, 0, 0))
# scaleX, scaleY, scaleZ: scaling factors provided by the user

def create_line(init_vector, scaleX, scaleY, scaleZ):
    # Use the provided initial vector
    v = init_vector

    # Use the provided scaling factors in the transformation matrix
    transformation_matrix = rg.Transform(0)  # identity matrix
    transformation_matrix.M00 = scaleX  
    transformation_matrix.M11 = scaleY  
    transformation_matrix.M22 = scaleZ  

    transformed_v = v
    transformed_v.Transform(transformation_matrix)

    # Create the line segment using the initial and transformed vectors
    line = rg.Line(rg.Point3d.Origin, rg.Point3d(rg.Point3d.Origin + transformed_v))

    return line

# Output
a = create_line(init_vector, scaleX, scaleY, scaleZ)
# ---------- end vectors_2 ----------
panel = Panel(vectors.out)
geometry = Geometry(vectors_2.a)  # disabled
geometry_2 = Geometry(vectors.a)
geometry_3 = Geometry(vectors.b)
# gpt-4 Initial Response
# To create a 3D geometric model using linear
# algebra and vectors in a Python script for the
# Grasshopper plugin in Rhino8WIP, you'll want to
#  use the Rhino Common API. Here's a simple
# example that creates a line segment in 3D
# space using vectors:
# 
# Start with a vector.
# Use linear algebra to transform it.
# Create a line segment in Rhino using the initial
# and transformed vectors.
panel_2 = Panel(vectors_2.out)  # disabled
entwine = Entwine(Branch00=geometry_2, Branch01=geometry_3, FlattenInputs=True)
entwine_2 = Entwine(Branch00=geometry, FlattenInputs=True)  # disabled
# gpt-4 Initial Response
# To create a more complex 3D model using
# trigonometric polynomials and the numpy library,
#  we can use parametric equations to define
# curves and surfaces. I'll introduce a function
# that uses trigonometric polynomials to create a
# parametric curve in 3D space. This curve's
# shape will depend on user-defined parameters,
# scaling factors, and initial vectors.
# 
# Let's start with a simple trigonometric polynomial for parametrically defining a 3D curve:
# 
# x(t)=acos(ωt)
# y(t)=bsin(ωt)
# z(t)=ccos(ωt)sin(ωt)
# 
# Here's how you can incorporate this into our previous Python script with the numpy library:
# 
# python
# Copy code
# import Rhino.Geometry as rg
# import numpy as np
# 
# # Parameters:
# # init_vector: initial vector provided by the user
# # scaleX, scaleY, scaleZ: scaling factors provided by the user
# # omega: frequency of the trigonometric polynomial
# 
# def create_line(init_vector, scaleX, scaleY, scaleZ):
#     # ... [rest of the previous function] ...
# 
#     return line
panel_3 = Panel(entwine)
panel_4 = Panel(entwine_2)  # disabled
