# Grasshopper definition 003_eigenvalues.gh (Grasshopper 1.0.7)
# plug-ins: RhinoCodePluginGH

# PARAMETRIC
number_slider = Slider(23, range=0..200)  # disabled
number_slider_2 = Slider(20, range=0..20)  # disabled
number_slider_3 = Slider(27, range=0..100)  # disabled
number_slider_4 = Slider(40, range=0..100)  # disabled
# 2nd gpt-4 Text Prompt
# Great, now make the script much more complex model
# with complex trigonometric polynomials and the
# NUMPY python library. Be sure to incorporate the previous code logic.
# ensure that this script produces 3d geometry as
# well for Data visualization purposes.
number_slider_5 = Slider(18, range=0..100)  # disabled
# ADVANCED
number_slider_6 = Slider(99, range=0..200)
# BASIC
eigenvalues = Script()  # -> out, output_points, output_centroid, output_lines; disabled
# ---------- eigenvalues: Python ----------
import Rhino.Geometry as rg
import numpy as np

def main():
    # Create a 3D point cloud with some random data (e.g., 100 points)
    n_points = 100
    points = []
    coordinates = np.zeros((n_points, 3))

    for i in range(n_points):
        x, y, z = np.random.rand(3) * 10
        point = rg.Point3d(x, y, z)
        points.append(point)
        coordinates[i, :] = [x, y, z]

    # Compute the centroid of the point cloud
    centroid = np.mean(coordinates, axis=0)

    # Translate points so that the centroid is at the origin
    coordinates -= centroid

    # Compute covariance matrix
    cov_matrix = np.cov(coordinates, rowvar=False)

    # Compute eigenvalues and eigenvectors
    eigenvalues, eigenvectors = np.linalg.eig(cov_matrix)

    # Create lines along the principal axes
    lines = []
    for eigenvector, eigenvalue in zip(eigenvectors.T, eigenvalues):
        start_point = rg.Point3d(centroid[0], centroid[1], centroid[2])
        end_coordinates = centroid + np.sqrt(eigenvalue) * eigenvector
        end_point = rg.Point3d(end_coordinates[0], end_coordinates[1], end_coordinates[2])
        line = rg.Line(start_point, end_point)
        lines.append(line)

    return points, rg.Point3d(centroid[0], centroid[1], centroid[2]), lines

# Run the main function and capture the output
points, centroid, lines = main()

# Output the generated points, centroid, and lines to different variable outputs
# Use these variable names in your Grasshopper Python node outputs to get the components
output_points = points
output_centroid = centroid
output_lines = lines
# ---------- end eigenvalues ----------
geometry = Geometry(eigenvalues.output_lines)  # disabled
geometry_2 = Geometry(eigenvalues.output_points)  # disabled
geometry_3 = Geometry(eigenvalues.output_centroid)  # disabled
# Becoming a Data Scientist
# with Python in Grasshopper
# at Wickerson Studios
# 001 Mathematics
# 001 LINEAR ALGEBRA
# 003 eigenvalues
# gpt-4 Text Prompt
# Create a geometric 3D model with
# 
# Mathematics
# 
# LINEAR ALGEBRA
# 
# eigenvalues
# 
# 
# in python 3 code for the python 3 script
# node in grasshopper for Rhino8WIP using the
# 
# Rhino Common API to create some geometry as well.
# 
# Output the parts of the model in different
# variable outputs in the python 3 node in
# grasshopper.
panel = Panel(eigenvalues.out)  # disabled
merge = Merge(Data1=number_slider_3, Data2=number_slider_4, Data3=number_slider_5)  # disabled
merge_2 = Merge(Data1=Slider(1, range=0..100), Data2=Slider(53, range=0..100), Data3=Slider(31, range=0..100))
entwine = Entwine(Branch00=geometry_2, Branch01=geometry_3, Branch02=geometry, FlattenInputs=True)  # disabled
eigenvalues_2 = Script(n_points=number_slider, random_range=number_slider_2, rotation_angles=merge)  # -> out, output_points, output_centroid, output_lines; inputs n_points: Int32, random_range: Int32, rotation_angles: list of Int32; disabled
# ---------- eigenvalues_2: Python ----------
import Rhino.Geometry as rg
import numpy as np
import math

def main(n_points=100, random_range=10, rotation_angles=(0, 0, 0)):
    # Create a 3D point cloud with some random data
    points = []
    coordinates = np.zeros((n_points, 3))

    for i in range(n_points):
        x, y, z = np.random.rand(3) * random_range
        point = rg.Point3d(x, y, z)
        points.append(point)
        coordinates[i, :] = [x, y, z]

    # Optional: Rotate the point cloud using Euler angles
    for i, angle in enumerate(rotation_angles):
        axis = rg.Vector3d(0, 0, 0)
        axis[i] = 1
        rotation_angle_rad = math.radians(angle)
        rotation_matrix = rg.Transform.Rotation(rotation_angle_rad, axis, rg.Point3d(0, 0, 0))
        for point in points:
            point.Transform(rotation_matrix)

    # Compute the centroid of the point cloud
    centroid = np.mean(coordinates, axis=0)

    # Translate points so that the centroid is at the origin
    coordinates -= centroid

    # Compute covariance matrix
    cov_matrix = np.cov(coordinates, rowvar=False)

    # Compute eigenvalues and eigenvectors
    eigenvalues, eigenvectors = np.linalg.eig(cov_matrix)

    # Create lines along the principal axes
    lines = []
    for eigenvector, eigenvalue in zip(eigenvectors.T, eigenvalues):
        start_point = rg.Point3d(centroid[0], centroid[1], centroid[2])
        end_coordinates = centroid + np.sqrt(eigenvalue) * eigenvector
        end_point = rg.Point3d(end_coordinates[0], end_coordinates[1], end_coordinates[2])
        line = rg.Line(start_point, end_point)
        lines.append(line)

    return points, rg.Point3d(centroid[0], centroid[1], centroid[2]), lines

# User-defined parameters
#n_points = 200  # Number of points in the cloud
#random_range = 20  # Range for random point generation
#rotation_angles = (30, 45, 60)  # Euler angles for rotation (in degrees)

# Run the main function and capture the output
points, centroid, lines = main(n_points, random_range, rotation_angles)

# Output the generated points, centroid, and lines to different variable outputs
# Use these variable names in your Grasshopper Python node outputs to get the components
output_points = points
output_centroid = centroid
output_lines = lines
# ---------- end eigenvalues_2 ----------
# eigenvalues
# eigenvectors
eigenvalues_3 = Script(
    n_points=number_slider_6,
    random_range=Slider(20, range=0..20),
    rotation_angles=merge_2,
    x_frequency=Slider(0, range=0..10),
    x_amplitude=Slider(7.65, range=0..10),
    x_phase=Slider(1.108, range=-5..5),
    y_frequency=Slider(2, range=0..10),
    y_amplitude=Slider(5, range=0..10),
    y_phase=Slider(1.108, range=-5..5),
    z_frequency=Slider(2, range=0..10),
    z_amplitude=Slider(5, range=0..10),
    z_phase=Slider(1.108, range=-5..5))  # -> out, output_points, output_centroid, output_lines; inputs n_points: Int32, random_range: Int32, rotation_angles: list of Int32, x_frequency: Double, x_amplitude: Double, x_phase: Double, y_frequency: Double, y_amplitude: Double, y_phase: Double, z_frequency: Double, z_amplitude: Double, z_phase: Double
# ---------- eigenvalues_3: Python ----------
import Rhino.Geometry as rg
import numpy as np
import math

def trig_function(x, frequency, amplitude, phase):
    return amplitude * np.sin(frequency * x + phase)

def main(n_points=100, random_range=10, rotation_angles=(0, 0, 0),
         x_frequency=1, x_amplitude=1, x_phase=0,
         y_frequency=1, y_amplitude=1, y_phase=0,
         z_frequency=1, z_amplitude=1, z_phase=0):
    # Create a 3D point cloud using trigonometric polynomials
    points = []
    coordinates = np.zeros((n_points, 3))

    for i in range(n_points):
        theta = np.random.rand() * 2 * np.pi
        phi = np.random.rand() * 2 * np.pi

        x = trig_function(theta, x_frequency, x_amplitude, x_phase) + np.random.rand() * random_range
        y = trig_function(phi, y_frequency, y_amplitude, y_phase) + np.random.rand() * random_range
        z = trig_function(theta + phi, z_frequency, z_amplitude, z_phase) + np.random.rand() * random_range

        point = rg.Point3d(x, y, z)
        points.append(point)
        coordinates[i, :] = [x, y, z]

    # Rotate the point cloud using Euler angles
    for i, angle in enumerate(rotation_angles):
        axis = rg.Vector3d(0, 0, 0)
        axis[i] = 1
        rotation_angle_rad = math.radians(angle)
        rotation_matrix = rg.Transform.Rotation(rotation_angle_rad, axis, rg.Point3d(0, 0, 0))
        for point in points:
            point.Transform(rotation_matrix)

    # Compute the centroid of the point cloud
    centroid = np.mean(coordinates, axis=0)

    # Translate points so that the centroid is at the origin
    coordinates -= centroid

    # Compute covariance matrix
    cov_matrix = np.cov(coordinates, rowvar=False)

    # Compute eigenvalues and eigenvectors
    eigenvalues, eigenvectors = np.linalg.eig(cov_matrix)

    # Create lines along the principal axes
    lines = []
    for eigenvector, eigenvalue in zip(eigenvectors.T, eigenvalues):
        start_point = rg.Point3d(centroid[0], centroid[1], centroid[2])
        end_coordinates = centroid + np.sqrt(eigenvalue) * eigenvector
        end_point = rg.Point3d(end_coordinates[0], end_coordinates[1], end_coordinates[2])
        line = rg.Line(start_point, end_point)
        lines.append(line)

    return points, rg.Point3d(centroid[0], centroid[1], centroid[2]), lines

# User-defined parameters in Grasshopper
"""
n_points = 200
random_range = 2
rotation_angles = (30, 45, 60)
x_frequency = 2
x_amplitude = 5
x_phase = 0
y_frequency = 3
y_amplitude = 5
y_phase = 0
z_frequency = 1
z_amplitude = 5
z_phase = 0
"""

# Run the main function and capture the output
points, centroid, lines = main(n_points, random_range, rotation_angles, x_frequency, x_amplitude, x_phase, y_frequency, y_amplitude, y_phase, z_frequency, z_amplitude, z_phase)

# Output the generated points, centroid, and lines to different variable outputs
output_points = points
output_centroid = centroid
output_lines = lines
# ---------- end eigenvalues_3 ----------
# gpt-4 Initial Response
# Creating a 3D geometric model that involves
# linear algebra, eigenvalues, and the Rhino
# Common API is a complex but interesting task.
# The code below is a Python 3 script that should
# run in a Python 3 node in Grasshopper for
# Rhino 8 WIP. This script uses NumPy for linear
# algebra computations and the Rhino Common
# API to create 3D geometry. Specifically, it
# creates a 3D point cloud and uses eigenvalues
# and eigenvectors to determine the orientation of
#  the cloud. Then it creates lines along those
# orientations.
# 
# First, install the NumPy package using the
# Rhino Python package manager (accessible via
# _EditPythonScript -> Tools -> PackageManager)
#  or use pip from the command line.
panel_2 = Panel(entwine)  # disabled
geometry_4 = Geometry(eigenvalues_2.output_lines)  # disabled
geometry_5 = Geometry(eigenvalues_2.output_points)  # disabled
geometry_6 = Geometry(eigenvalues_2.output_centroid)  # disabled
panel_3 = Panel(eigenvalues_2.out)  # disabled
geometry_7 = Geometry(eigenvalues_3.output_centroid)
geometry_8 = Geometry(eigenvalues_3.output_points)
geometry_9 = Geometry(eigenvalues_3.output_lines)
panel_4 = Panel(eigenvalues_3.out)
# gpt-4 Initial Response
entwine_2 = Entwine(Branch00=geometry_5, Branch01=geometry_6, Branch02=geometry_4, FlattenInputs=True)  # disabled
entwine_3 = Entwine(Branch00=geometry_8, Branch01=geometry_7, Branch02=geometry_9, FlattenInputs=True)
panel_5 = Panel(entwine_2)  # disabled
# Certainly, let's take the previous example and
# make it more complex by incorporating
# trigonometric polynomials into the point
# generation logic. We'll use NumPy to create a
# trigonometric function that determines the x, y,
# and z coordinates of the points in the cloud,
# adding more complexity to the model.
panel_6 = Panel(entwine_3)
