# Grasshopper definition A_002_matrices.gh (Grasshopper 1.0.7)
# plug-ins: RhinoCodePluginGH

# ADVANCED
number_slider = Slider(4.32, range=0..10)
# PARAMETRIC
number_slider_2 = Slider(4.32, range=0..10)  # disabled
number_slider_3 = Slider(1.33, range=0..10)  # disabled
number_slider_4 = Slider(3.26, range=0..10)  # disabled
number_slider_5 = Slider(6.96, range=0..10)  # disabled
number_slider_6 = Slider(5.17, range=0..10)  # disabled
# 2nd gpt-4 Text Prompt
number_slider_7 = Slider(3.72, range=0..10)  # disabled
matrices = Script()  # -> out, a, b; disabled
# ---------- matrices: Python ----------
import Rhino.Geometry as rg
import math
import numpy as np

def transform_point(p, translation, rotation, scale):
    # Create translation matrix
    T = np.array([
        [1, 0, 0, translation[0]],
        [0, 1, 0, translation[1]],
        [0, 0, 1, translation[2]],
        [0, 0, 0, 1]
    ])
    
    # Create rotation matrix about Z-axis
    theta = math.radians(rotation)
    R = np.array([
        [math.cos(theta), -math.sin(theta), 0, 0],
        [math.sin(theta),  math.cos(theta), 0, 0],
        [0,               0,                1, 0],
        [0,               0,                0, 1]
    ])
    
    # Create scaling matrix
    S = np.array([
        [scale, 0,     0,     0],
        [0,     scale, 0,     0],
        [0,     0,     scale, 0],
        [0,     0,     0,     1]
    ])
    
    # Convert Rhino point to homogeneous coordinates
    point_vec = np.array([p.X, p.Y, p.Z, 1]).reshape(4, 1)
    
    # Apply transformations
    point_transformed = np.dot(T, np.dot(R, np.dot(S, point_vec)))
    
    # Convert back to Rhino Point3d
    transformed_point = rg.Point3d(point_transformed[0][0], point_transformed[1][0], point_transformed[2][0])
    
    return transformed_point

# Sample point (Can be an input in Grasshopper)
p = rg.Point3d(1, 1, 1)

# Apply transformations (Can be inputs in Grasshopper)
translation = [5, 5, 5]
rotation = 45  # Degrees
scale = 2

transformed_point = transform_point(p, translation, rotation, scale)

# Create a sphere at the transformed point and convert it to Brep
sphere = rg.Sphere(transformed_point, 1)  # The 1 is the radius
brep_sphere = sphere.ToBrep()

# Output (Will be connected to the Grasshopper Python node output)
a = transformed_point
b = brep_sphere
# ---------- end matrices ----------
geometry = Geometry(matrices.a)  # disabled
geometry_2 = Geometry(matrices.b)  # disabled
# Becoming a Data Scientist
# with Python in Grasshopper
# at Wickerson Studios
# 001 Mathematics
# 001 LINEAR ALGEBRA
# 002 matrices
# gpt-4 Text Prompt
# Create a geometric 3D model with
# 
# Mathematics
# 
# LINEAR ALGEBRA
# 
# matrices
# 
# 
# in python 3 code for the python 3 script
# node in grasshopper for Rhino8WIP using the
# 
# Rhino Common API to create some geometry as well.
# 
# Output the parts of the model in different
# variable outputs in the python 3 node in
# grasshopper.
# BASIC
panel = Panel(matrices.out)  # disabled
number_slider_8 = Slider(188.79, range=0..360)  # disabled
number_slider_9 = Slider(0.64, range=0..3)  # disabled
# Great, now make the script much more complex model
# with complex trigonometric polynomials and the
# NUMPY python library. Be sure to incorporate the previous code logic.
# ensure that this script produces 3d geometry as
# well for Data visualization purposes.
number_slider_10 = Slider(2.61, range=0..10)  # disabled
vector_xyz = VectorXYZ(XComponent=Slider(6.96, range=0..10), YComponent=Slider(5.17, range=0..10), ZComponent=Slider(3.72, range=0..10))  # -> Vector, Length
entwine = Entwine(Branch00=geometry, Branch01=geometry_2, FlattenInputs=True)  # disabled
construct_point = ConstructPoint(XCoordinate=number_slider, YCoordinate=Slider(1.33, range=0..10), ZCoordinate=Slider(3.26, range=0..10))
vector_xyz_2 = VectorXYZ(XComponent=number_slider_5, YComponent=number_slider_6, ZComponent=number_slider_7)  # -> Vector, Length; disabled
construct_point_2 = ConstructPoint(XCoordinate=number_slider_2, YCoordinate=number_slider_3, ZCoordinate=number_slider_4)  # disabled
# gpt-4 Initial Response
# Creating a geometric 3D model using linear
# algebra, matrices, and Python requires some
# understanding of the target geometry you wish
# to create and manipulate. For this example, let's
# create a simple script that uses matrices to
# translate, rotate, and scale a 3D point in space,
#  then visualize this point as a sphere in Rhino
# using the Grasshopper Python node.
panel_2 = Panel(entwine)  # disabled
matrices_2 = Script(
    startPoint=construct_point,
    transVec=vector_xyz.Vector,
    rotAngle=Slider(122.69, range=0..360),
    scaleFactor=Slider(0.86, range=0..3),
    radius=Slider(2.68, range=0..10))  # -> out, a, b; inputs startPoint: Point3d, transVec: Vector3d, rotAngle: Double, scaleFactor: Double, radius: Double
# ---------- matrices_2: Python ----------
import Rhino.Geometry as rg
import math
import numpy as np

def transform_point(p, translation, rotation, scale):
    # Create translation matrix
    T = np.array([
        [1, 0, 0, translation[0]],
        [0, 1, 0, translation[1]],
        [0, 0, 1, translation[2]],
        [0, 0, 0, 1]
    ])
    
    # Create rotation matrix about Z-axis
    theta = math.radians(rotation)
    R = np.array([
        [math.cos(theta), -math.sin(theta), 0, 0],
        [math.sin(theta),  math.cos(theta), 0, 0],
        [0,               0,                1, 0],
        [0,               0,                0, 1]
    ])
    
    # Create scaling matrix
    S = np.array([
        [scale, 0,     0,     0],
        [0,     scale, 0,     0],
        [0,     0,     scale, 0],
        [0,     0,     0,     1]
    ])
    
    # Convert Rhino point to homogeneous coordinates
    point_vec = np.array([p.X, p.Y, p.Z, 1]).reshape(4, 1)
    
    # Apply transformations
    point_transformed = np.dot(T, np.dot(R, np.dot(S, point_vec)))
    
    # Convert back to Rhino Point3d
    transformed_point = rg.Point3d(point_transformed[0][0], point_transformed[1][0], point_transformed[2][0])
    
    return transformed_point

# Using provided inputs
transformed_point = transform_point(startPoint, transVec, rotAngle, scaleFactor)

# Create a sphere at the transformed point and convert it to Brep
sphere = rg.Sphere(transformed_point, radius)
brep_sphere = sphere.ToBrep()

# Outputs
a = transformed_point
b = brep_sphere
# ---------- end matrices_2 ----------
matrices_3 = Script(
    startPoint=construct_point_2,
    transVec=vector_xyz_2.Vector,
    rotAngle=number_slider_8,
    scaleFactor=number_slider_9,
    radius=number_slider_10)  # -> out, a, b; inputs startPoint: Point3d, transVec: Vector3d, rotAngle: Double, scaleFactor: Double, radius: Double; disabled; same code as matrices_2
panel_3 = Panel(matrices_2.out)
geometry_3 = Geometry(matrices_2.b)
geometry_4 = Geometry(matrices_2.a)
panel_4 = Panel(matrices_3.out)  # disabled
geometry_5 = Geometry(matrices_3.b)  # disabled
geometry_6 = Geometry(matrices_3.a)  # disabled
entwine_2 = Entwine(Branch00=geometry_4, Branch01=geometry_3, FlattenInputs=True)
entwine_3 = Entwine(Branch00=geometry_6, Branch01=geometry_5, FlattenInputs=True)  # disabled
# gpt-4 Initial Response
# Certainly! We can create a more complex parametric model using
# trigonometric functions and polynomials to generate more intricate shapes.
# 
# For this example, let's consider a helix-like curve based on trigonometric
# functions and polynomials, and on this helix, we'll place spheres whose
# sizes vary based on a trigonometric polynomial.
# 
# Steps:
# Generate a helix-like curve using trigonometric functions and polynomials.
# Sample points along this curve.
# For each sample point, compute a size for a sphere using a trigonometric polynomial.
# Place spheres of the computed size on each sample point.
# Transform this geometry using the logic from the previous code.
panel_5 = Panel(entwine_2)
panel_6 = Panel(entwine_3)  # disabled
