# Grasshopper definition A_005_Singular_Value_Decomposition_(SVD).gh (Grasshopper 1.0.7)
# plug-ins: RhinoCodePluginGH

# ----
# Oscillation Algorithm
# The oscillation algorithm can be use to animate
# any geometry that is driven by a number sliders.
# Simply swap out the number sliders at the
# multiplication node in the oscillation script.
panel = Panel("1")  # disabled
trigger = Trigger(Interval=20, TimerInterval=20, Target=data_recorder)  # disabled
data_recorder = DataRecorder(panel, DataLimit=-10, RecordData=False)  # disabled
number_slider = Slider(49, range=0..1000)  # disabled
list_length = ListLength(List=data_recorder)  # disabled
division = Division(A=list_length, B=number_slider)  # disabled
cosine = Cosine(Value=division)  # disabled
sine = Sine(Value=division)  # disabled
panel_2 = Panel([sine, cosine])  # disabled
multiplication = Multiplication(A=sine)  # disabled
multiplication_2 = Multiplication(A=cosine)  # disabled

# ----
# ADVANCED
number_slider_2 = Slider(45, range=0..100)
number_slider_3 = Slider(100, range=0..100)
# 2nd gpt-4 Text Prompt
# Great, now make the script much more complex model
# with complex trigonometric polynomials and the
# NUMPY python library. Be sure to incorporate the previous code logic.
# ensure that this script produces 3d geometry as
# well for Data visualization purposes.
number_slider_4 = Slider(3.13, range=-10..10)  # disabled
# PARAMETRIC
number_slider_5 = Slider(4.4, range=-10..10)  # disabled
number_slider_6 = Slider(-0.11, range=-10..10)  # disabled
# 001 Mathematics
# 001 LINEAR ALGEBRA
# 005 Singular Value Decomposition (SVD)
# gpt-4 Text Prompt
# Create a geometric 3D model with
# 
# Mathematics
# 
# LINEAR ALGEBRA
# 
# Singular Value Decomposition (SVD)
# 
# 
# in python 3 code for the python 3 script
# node in grasshopper for Rhino8WIP using the
# 
# Rhino Common API to create some geometry as well.
# 
# Output the parts of the model in different
# variable outputs in the python 3 node in
# grasshopper.
# BASIC
single_value_decomposition = Script()  # -> out, a, b; disabled
# ---------- single_value_decomposition: Python ----------
import Rhino.Geometry as rg
import numpy as np

# Define the 3D model
# For this example, we'll create a simple 3D model of a cube
points = np.array([
    [0, 0, 0],
    [1, 0, 0],
    [1, 1, 0],
    [0, 1, 0],
    [0, 0, 1],
    [1, 0, 1],
    [1, 1, 1],
    [0, 1, 1]
], dtype=float)  # Make sure the array is of float type

# Perform Singular Value Decomposition (SVD)
U, S, Vt = np.linalg.svd(points)

# Reconstruct the 3D model
S_diag = np.zeros((U.shape[0], Vt.shape[0]))
for i in range(len(S)):
    S_diag[i, i] = S[i]
reconstructed_points = np.dot(U, np.dot(S_diag, Vt))

# Convert numpy arrays to lists of Rhino Point3d objects for visualization
original_points_rhino = [rg.Point3d(pt[0], pt[1], pt[2]) for pt in points]
reconstructed_points_rhino = [rg.Point3d(pt[0], pt[1], pt[2]) for pt in reconstructed_points]

# Output original and reconstructed points
a = original_points_rhino
b = reconstructed_points_rhino
# ---------- end single_value_decomposition ----------
geometry = Geometry(single_value_decomposition.b)  # disabled
geometry_2 = Geometry(single_value_decomposition.a)  # disabled
panel_3 = Panel(single_value_decomposition.out)  # disabled
number_slider_7 = Slider(0.82, range=0.1..5)  # disabled
number_slider_8 = Slider(3.6, range=0..10)  # disabled
single_value_decomposition_2 = Script(
    rows=number_slider_2,
    columns=number_slider_2,
    freq=Slider(0.8, range=0..10),
    amplitude=Slider(0.64, range=0.1..5),
    scale_factor=Slider(5, range=0.1..5))  # -> out, a, b; inputs rows: Int32, columns: Int32, freq: Double, amplitude: Double, scale_factor: Double
# ---------- single_value_decomposition_2: Python ----------
import Rhino.Geometry as rg
import numpy as np

def create_complex_model(rows=10, columns=10, freq=2, amplitude=1, scale_factor=1):
    # Check if rows and columns are integers or lists
    if isinstance(rows, list):
        rows = rows[0]
    if isinstance(columns, list):
        columns = columns[0]
        
    if not isinstance(rows, int) or not isinstance(columns, int):
        return "Invalid input: rows and columns should be integers", None

    # Create a 3D surface using trigonometric polynomials
    x = np.linspace(-np.pi, np.pi, rows)
    y = np.linspace(-np.pi, np.pi, columns)
    X, Y = np.meshgrid(x, y)
    Z = amplitude * np.sin(freq * X) * np.cos(freq * Y)
    
    points = np.array([X.flatten(), Y.flatten(), Z.flatten()]).T
    
    # Apply scaling
    points *= scale_factor

    # Perform Singular Value Decomposition (SVD)
    U, S, Vt = np.linalg.svd(points)

    # Reconstruct the 3D model
    S_diag = np.zeros((U.shape[0], Vt.shape[0]))
    for i in range(len(S)):
        S_diag[i, i] = S[i]
        
    reconstructed_points = np.dot(U, np.dot(S_diag, Vt))

    # Convert numpy arrays to lists of Rhino Point3d objects for visualization
    original_points_rhino = [rg.Point3d(pt[0], pt[1], pt[2]) for pt in points]
    reconstructed_points_rhino = [rg.Point3d(pt[0], pt[1], pt[2]) for pt in reconstructed_points]

    return original_points_rhino, reconstructed_points_rhino

# Input parameters to make the model parametric
#rows = 10  # Number of rows for the surface grid
#columns = 10  # Number of columns for the surface grid
#freq = 2  # Frequency for the trigonometric polynomial
#amplitude = 1  # Amplitude for the trigonometric polynomial
#scale_factor = 1.0  # Scale factor to scale the model

# Output original and reconstructed points
a, b = create_complex_model(rows, columns, freq, amplitude, scale_factor)
# ---------- end single_value_decomposition_2 ----------
merge = Merge(Data1=number_slider_5, Data2=number_slider_6, Data3=number_slider_4)  # disabled
entwine = Entwine(Branch00=geometry_2, Branch01=geometry, FlattenInputs=True)  # disabled
# Becoming a Data Scientist
# with Python in Grasshopper
# at Wickerson Studios
# gpt-4 Initial Response
# Creating a 3D model using Singular Value
# Decomposition (SVD) involves several steps.
# Here's an outline of the steps you need to
# follow:
# 
# Install Required Packages: You need to install
# numpy for linear algebra operations, and
# rhino3dm for creating and manipulating 3D
# models using Rhino Common API.
# 
# Define the 3D model: Create a 3D model or
# import an existing one.
# 
# Singular Value Decomposition (SVD): Perform
# SVD on the coordinates of the points of the 3D
# model. SVD is used to decompose a matrix into
# three other matrices: U, Σ, and V^T.
# 
# Reconstruct the 3D model: Use the
# decomposed matrices to reconstruct the 3D
# model.
# 
# Visualize the 3D model: Visualize the original
# and reconstructed 3D model.
panel_4 = Panel(entwine)  # disabled
single_value_decomposition_3 = Script(size=number_slider_8, offset=merge, scale_factor=number_slider_7)  # -> out, a, b; inputs size: Double, offset: list; disabled
# ---------- single_value_decomposition_3: Python ----------
import Rhino.Geometry as rg
import numpy as np

def create_model(size=1.0, offset=[0.0, 0.0, 0.0], scale_factor=1.0):
    # Define a 3D cube model based on the size and offset parameters
    points = np.array([
        [0, 0, 0],
        [1, 0, 0],
        [1, 1, 0],
        [0, 1, 0],
        [0, 0, 1],
        [1, 0, 1],
        [1, 1, 1],
        [0, 1, 1]
    ], dtype=float)
    
    # Apply size, offset and scaling
    points *= size
    points += offset
    points *= scale_factor

    # Perform Singular Value Decomposition (SVD)
    U, S, Vt = np.linalg.svd(points)

    # Reconstruct the 3D model
    S_diag = np.zeros((U.shape[0], Vt.shape[0]))
    for i in range(len(S)):
        S_diag[i, i] = S[i]
    reconstructed_points = np.dot(U, np.dot(S_diag, Vt))

    # Convert numpy arrays to lists of Rhino Point3d objects for visualization
    original_points_rhino = [rg.Point3d(pt[0], pt[1], pt[2]) for pt in points]
    reconstructed_points_rhino = [rg.Point3d(pt[0], pt[1], pt[2]) for pt in reconstructed_points]

    return original_points_rhino, reconstructed_points_rhino

# Input parameters to make the model parametric
#size = 1.0  # Size of the cube
#offset = [0.0, 0.0, 0.0]  # Offset to move the cube
#scale_factor = 1.0  # Scale factor to scale the cube

# Output original and reconstructed points
a, b = create_model(size, offset, scale_factor)
# ---------- end single_value_decomposition_3 ----------
geometry_3 = Geometry(single_value_decomposition_2.a)
geometry_4 = Geometry(single_value_decomposition_2.b)
panel_5 = Panel(single_value_decomposition_2.out)
surface_from_points = SurfaceFromPoints(Points=geometry_4, UCount=number_slider_2, Interpolate=False)
geometry_5 = Geometry(single_value_decomposition_3.b)  # disabled
geometry_6 = Geometry(single_value_decomposition_3.a)  # disabled
entwine_2 = Entwine(Branch00=geometry_3, Branch01=geometry_4, FlattenInputs=True)
panel_6 = Panel(single_value_decomposition_3.out)  # disabled
# Certainly! Below is an example of a more
# complex parametric Python script that integrates
#  trigonometric polynomials to create a 3D
# surface. This surface is then passed through
# Singular Value Decomposition (SVD) as with
# the cube in the previous example.
panel_7 = Panel(entwine_2)
# gpt-4 Initial Response
entwine_3 = Entwine(Branch00=geometry_6, Branch01=geometry_5, FlattenInputs=True)  # disabled
panel_8 = Panel(entwine_3)  # disabled
