# Grasshopper definition A_006_gradient.gh (Grasshopper 1.0.7)
# plug-ins: RhinoCodePluginGH, Bifocals

# ----
# Oscillation Algorithm
# The oscillation algorithm can be use to animate
# any geometry that is driven by a number sliders.
# Simply swap out the number sliders at the
# multiplication node in the oscillation script.
panel = Panel("1")  # disabled
trigger = Trigger(Interval=20, TimerInterval=20, Target=data_recorder)  # disabled
data_recorder = DataRecorder(panel, DataLimit=-10, RecordData=False)  # disabled
number_slider = Slider(49, range=0..1000)  # disabled
list_length = ListLength(List=data_recorder)  # disabled
division = Division(A=list_length, B=number_slider)  # disabled
cosine = Cosine(Value=division)  # disabled
sine = Sine(Value=division)  # disabled
panel_2 = Panel([sine, cosine])  # disabled

number_slider_2 = Slider(2.99, range=0..10)  # disabled
number_slider_3 = Slider(12, range=0..100)  # disabled
# 2nd gpt-4 Text Prompt
# Great, now make the script much more complex model
# with complex trigonometric polynomials and the
# NUMPY python library. Be sure to incorporate the previous code logic.
# ensure that this script produces 3d geometry as
# well for Data visualization purposes.
number_slider_4 = Slider(7.55, range=0..10)  # disabled
# BASIC
gradient = Script()  # -> out, a, b; disabled
# ---------- gradient: Python ----------
import Rhino
import scriptcontext
import numpy as np

# Create a sphere
center = Rhino.Geometry.Point3d(0, 0, 0)
radius = 5.0
sphere = Rhino.Geometry.Sphere(center, radius)

# Convert sphere to Brep representation
brep_sphere = sphere.ToBrep()

# Define a function
def func(x, y, z):
    return x * y + y * z + z * x

# Compute the function values and gradients at the surface points of the sphere
num_points = 50
theta = np.linspace(0, 2 * np.pi, num_points)
phi = np.linspace(0, np.pi, num_points)
x = radius * np.outer(np.cos(theta), np.sin(phi))
y = radius * np.outer(np.sin(theta), np.sin(phi))
z = radius * np.outer(np.ones(np.size(theta)), np.cos(phi))

values = func(x, y, z)

# Manually compute the gradient (this is a simplified example)
grad_x = 2 * x
grad_y = 2 * y
grad_z = 2 * z

# Create a gradient color based on the z-coordinate of each point
colors = []
for i in range(num_points):
    for j in range(num_points):
        color = Rhino.Display.ColorHSL(0.6 - 0.6 * (z[i, j] / radius), 1.0, 0.5).ToArgbColor()
        colors.append(color)

# Output the parts of the model
a = brep_sphere
b = colors
# ---------- end gradient ----------
number_slider_5 = Slider(3.75, range=0..10)  # disabled
# ADVANCED
construct_point = ConstructPoint(XCoordinate=0, YCoordinate=0, ZCoordinate=0)
# PARAMETRIC
construct_point_2 = ConstructPoint(XCoordinate=0, YCoordinate=0, ZCoordinate=0)  # disabled
panel_3 = Panel(gradient.b)  # disabled
geometry = Geometry(gradient.a)  # disabled
# 001 LINEAR ALGEBRA
# 006 Gradient
# gpt-4 Text Prompt
# Create a geometric 3D model with
# 
# Mathematics
# 
# LINEAR ALGEBRA
# 
# Gradient
# 
# 
# in python 3 code for the python 3 script
# node in grasshopper for Rhino8WIP using the
# 
# Rhino Common API to create some geometry as well.
# 
# Output the parts of the model in different
# variable outputs in the python 3 node in
# grasshopper.
panel_4 = Panel(gradient.out)  # disabled
gradient_2 = Script(
    center=construct_point_2,
    radius=number_slider_2,
    num_points=number_slider_3,
    minHue=number_slider_5,
    maxHue=number_slider_4)  # -> out, a, b; inputs center: Point3d, radius: Double, num_points: Int32, minHue: Double, maxHue: Double; disabled
# ---------- gradient_2: Python ----------
import Rhino
import scriptcontext
import numpy as np

# Create a sphere
# The input 'center' should be a Point3d from Grasshopper
# The input 'radius' should be a float from Grasshopper
sphere = Rhino.Geometry.Sphere(center, radius)

# Convert sphere to Brep representation
brep_sphere = sphere.ToBrep()

# Define a function
def func(x, y, z):
    return x * y + y * z + z * x

# Compute the function values and gradients at the surface points of the sphere
# The input 'num_points' should be an integer from Grasshopper
theta = np.linspace(0, 2 * np.pi, num_points)
phi = np.linspace(0, np.pi, num_points)
x = radius * np.outer(np.cos(theta), np.sin(phi))
y = radius * np.outer(np.sin(theta), np.sin(phi))
z = radius * np.outer(np.ones(np.size(theta)), np.cos(phi))

values = func(x, y, z)

# Manually compute the gradient (this is a simplified example)
grad_x = 2 * x
grad_y = 2 * y
grad_z = 2 * z

# Create a gradient color based on the z-coordinate of each point
# The inputs 'minHue' and 'maxHue' should be floats from Grasshopper
colors = []
for i in range(num_points):
    for j in range(num_points):
        hue = minHue + (maxHue - minHue) * (z[i, j] / radius)
        color = Rhino.Display.ColorHSL(hue, 1.0, 0.5).ToArgbColor()
        colors.append(color)

# Output the parts of the model
a = brep_sphere
b = colors
# ---------- end gradient_2 ----------
entwine = Entwine(Branch00=geometry, Branch01=panel_3, FlattenInputs=True)  # disabled
gradient_3 = Script(
    center=construct_point,
    radius=Slider(3.33, range=0..10),
    num_points=Slider(21, range=0..100),
    minHue=Slider(3.48, range=0..10),
    maxHue=Slider(7.55, range=0..10))  # -> out, a, b, c; inputs center: Point3d, radius: Double, num_points: Int32, minHue: Double, maxHue: Double
# ---------- gradient_3: Python ----------
import Rhino
import scriptcontext
import numpy as np

# Create the base sphere
# Inputs from Grasshopper: center, radius
sphere = Rhino.Geometry.Sphere(center, radius)
brep_sphere = sphere.ToBrep()

# Define a complex trigonometric polynomial function
def complex_func(x, y, z):
    return np.sin(x) * np.cos(y) + np.cos(x) * np.sin(z) + np.tan(y) + np.log1p(np.abs(z))

# Create a more complex 3D point set
# Input from Grasshopper: num_points
theta = np.linspace(0, 2 * np.pi, num_points)
phi = np.linspace(0, np.pi, num_points)

x = radius * np.outer(np.cos(theta), np.sin(phi))
y = radius * np.outer(np.sin(theta), np.sin(phi))
z = radius * np.outer(np.ones(np.size(theta)), np.cos(phi))

# Evaluate the complex function
values = complex_func(x, y, z)

# Compute the gradient
grad_x = np.gradient(values, axis=0)
grad_y = np.gradient(values, axis=1)

# Generate colors for the point set
# Inputs from Grasshopper: minHue, maxHue
colors = []
for i in range(num_points):
    for j in range(num_points):
        hue = minHue + (maxHue - minHue) * ((np.sin(values[i, j]) + 1.0) / 2.0)
        color = Rhino.Display.ColorHSL(hue, 1.0, 0.5).ToArgbColor()
        colors.append(color)

# Create 3D geometry for data visualization
points = []
for i in range(num_points):
    for j in range(num_points):
        point = Rhino.Geometry.Point3d(x[i, j], y[i, j], z[i, j] + values[i, j])
        points.append(point)

# Add points to Rhino document
for pt in points:
    scriptcontext.doc.Objects.AddPoint(pt)

# Output variables
# 'a', 'b', and 'c' would be output variables connected to the Grasshopper node
a = brep_sphere
b = colors
c = points
# ---------- end gradient_3 ----------
panel_5 = Panel(gradient_2.b)  # disabled
# Becoming a Data Scientist
# with Python in Grasshopper
# at Wickerson Studios
# 001 Mathematics
# gpt-4 Initial Response
# Creating a geometric 3D model using Python,
# linear algebra, gradients, and the Rhino
# Common API in a Grasshopper node for Rhino
# 8 WIP involves several steps.
# 
# Install Rhino 8 WIP and Grasshopper: Ensure
# you have Rhino 8 WIP and Grasshopper
# installed on your machine.
# 
# Install GHPython: Install the GHPython plugin
# for Grasshopper if you haven't already. This
# allows you to run Python scripts in Grasshopper.
# 
# 
# Create a Python Script: Create a Python script
# using the Rhino Common API, linear algebra,
# and gradients. You will input this script into the
# GHPython node in Grasshopper.
panel_6 = Panel(entwine)  # disabled
panel_7 = Panel(gradient_2.out)  # disabled
geometry_2 = Geometry(gradient_2.a)  # disabled
panel_8 = Panel(gradient_3.b)
panel_9 = Panel(gradient_3.out)
geometry_3 = Geometry(gradient_3.a)
geometry_4 = Geometry(gradient_3.c)
# gpt-4 Initial Response
# Certainly! Below is a more complex example that
# creates multiple layers of geometry based on
# complex trigonometric polynomials and utilizes
# NumPy. This script outputs both the original
# sphere and a new set of 3D points based
# oncomplex polynomial calculations.
# 
# Here's how the code works:
# 
# We still create a base sphere as before.
# Then we create a more complex 3D point set
# based on trigonometric polynomials.
# The colors of the 3D point set are also more
# complexly generated.
entwine_2 = Entwine(Branch00=geometry_2, Branch01=panel_5, FlattenInputs=True)  # disabled
entwine_3 = Entwine(Branch00=geometry_3, Branch01=panel_8, Branch02=geometry_4, FlattenInputs=True)
panel_10 = Panel(entwine_2)  # disabled
panel_11 = Panel(entwine_3)
