# Grasshopper definition A_007_Tensors.gh (Grasshopper 1.0.7)
# plug-ins: RhinoCodePluginGH

# ----
# Oscillation Algorithm
# The oscillation algorithm can be use to animate
# any geometry that is driven by a number sliders.
# Simply swap out the number sliders at the
# multiplication node in the oscillation script.
panel = Panel("1")  # disabled
trigger = Trigger(Interval=20, TimerInterval=20, Target=data_recorder)  # disabled
data_recorder = DataRecorder(panel, DataLimit=-10, RecordData=False)  # disabled
number_slider = Slider(15, range=0..1000)  # disabled
list_length = ListLength(List=data_recorder)  # disabled
division = Division(A=list_length, B=number_slider)  # disabled
cosine = Cosine(Value=division)  # disabled
sine = Sine(Value=division)  # disabled
panel_2 = Panel([sine, cosine])  # disabled

number_slider_2 = Slider(-0.39, range=-3..3)
multiplication = Multiplication(A=sine, B=number_slider_2)  # disabled
number_slider_3 = Slider(-0.27, range=-3..3)
multiplication_2 = Multiplication(A=cosine, B=number_slider_3)  # disabled
# PARAMETRIC
number_slider_4 = Slider(4, range=0..10)  # disabled
number_slider_5 = Slider(6, range=0..10)  # disabled
number_slider_6 = Slider(4, range=0..10)  # disabled
number_slider_7 = Slider(5.24, range=0..10)  # disabled
number_slider_8 = Slider(8.01, range=0..10)  # disabled
# 2nd gpt-4 Text Prompt
# Great, now make the script much more complex model
# with complex trigonometric polynomials and the
# NUMPY python library. Be sure to incorporate the previous code logic.
# ensure that this script produces 3d geometry as
# well for Data visualization purposes.
# ADVANCED
number_slider_9 = Slider(2.89, range=0..10)  # disabled
# BASIC
tensors = Script()  # -> out, a; disabled
# ---------- tensors: Python ----------
import Rhino.Geometry as rg
import numpy as np

# Input parameters
x_count = 10  # number of points in the x direction
y_count = 10  # number of points in the y direction
z_count = 10  # number of points in the z direction

# Generate 3D grid of points using numpy
x = np.linspace(0, 10, x_count)
y = np.linspace(0, 10, y_count)
z = np.linspace(0, 10, z_count)
xx, yy, zz = np.meshgrid(x, y, z)
points = np.vstack([xx.ravel(), yy.ravel(), zz.ravel()]).T

# Convert numpy array to list of Rhino.Geometry.Point3d
points = [rg.Point3d(*pt) for pt in points]

# Output
a = points
# ---------- end tensors ----------
panel_3 = Panel()  # disabled
geometry = Geometry(tensors.a)  # disabled
# 001 LINEAR ALGEBRA
# 007_Tensors
# gpt-4 Text Prompt
# Create a geometric 3D model with
# 
# Mathematics
# 
# LINEAR ALGEBRA
# 
# Tensors
# 
# 
# in python 3 code for the python 3 script
# node in grasshopper for Rhino8WIP using the
# 
# Rhino Common API to create some geometry as well.
# 
# Output the parts of the model in different
# variable outputs in the python 3 node in
# grasshopper.
panel_4 = Panel(tensors.out)  # disabled
tensors_2 = Script(
    x_count=Slider(6, range=0..10),
    y_count=Slider(6, range=0..10),
    z_count=Slider(3, range=0..10),
    x_range=Slider(4.36, range=0..10),
    y_range=Slider(4, range=0..10),
    z_range=Slider(2.89, range=0..10),
    freq=number_slider_2,
    amp=number_slider_3)  # -> out, a, b; inputs x_count: Int32, y_count: Int32, z_count: Int32, x_range: Double, y_range: Double, z_range: Double, freq: Double, amp: Double
# ---------- tensors_2: Python ----------
import Rhino.Geometry as rg
import numpy as np

# Input parameters from Grasshopper
# x_count = x_count  # number of points in the x direction (Input)
# y_count = y_count  # number of points in the y direction (Input)
# z_count = z_count  # number of points in the z direction (Input)
# x_range = x_range  # range in the x direction (Input)
# y_range = y_range  # range in the y direction (Input)
# z_range = z_range  # range in the z direction (Input)
# freq = freq        # frequency parameter for trigonometric function (Input)
# amp = amp          # amplitude parameter for trigonometric function (Input)

# Generate 3D grid of points using numpy
x = np.linspace(0, x_range, x_count)
y = np.linspace(0, y_range, y_count)
z = np.linspace(0, z_range, z_count)
xx, yy, zz = np.meshgrid(x, y, z)

# Modify z-coordinates based on a complex trigonometric polynomial
# For example, using cos and sin functions to modify the z-coordinate
zz = zz + amp * np.cos(freq * xx) * np.sin(freq * yy)

# Stack the x, y, and z arrays to make the 3D coordinates
points = np.vstack([xx.ravel(), yy.ravel(), zz.ravel()]).T

# Convert numpy array to list of Rhino.Geometry.Point3d
points = [rg.Point3d(*pt) for pt in points]

# Create 3D geometry for data visualization. 
# For example, creating lines connecting adjacent points.
lines = []
for i in range(0, x_count * y_count * z_count):
    xi, yi, zi = i % x_count, (i // x_count) % y_count, i // (x_count * y_count)
    if xi < x_count - 1:
        lines.append(rg.Line(points[i], points[i+1]))
    if yi < y_count - 1:
        lines.append(rg.Line(points[i], points[i+x_count]))
    if zi < z_count - 1:
        lines.append(rg.Line(points[i], points[i+x_count*y_count]))

# Output
a = points  # Connect this to an output node in Grasshopper for points
b = lines   # Connect this to another output node in Grasshopper for lines
# ---------- end tensors_2 ----------
tensors_3 = Script(
    x_count=number_slider_4,
    y_count=number_slider_5,
    z_count=number_slider_6,
    x_range=number_slider_7,
    y_range=number_slider_8,
    z_range=number_slider_9)  # -> out, a; inputs x_count: Int32, y_count: Int32, z_count: Int32, x_range: Double, y_range: Double, z_range: Double; disabled
# ---------- tensors_3: Python ----------
import Rhino.Geometry as rg
import numpy as np

# Input parameters from Grasshopper
# x_count = x_count  # number of points in the x direction (Input)
# y_count = y_count  # number of points in the y direction (Input)
# z_count = z_count  # number of points in the z direction (Input)
# x_range = x_range  # range in the x direction (Input)
# y_range = y_range  # range in the y direction (Input)
# z_range = z_range  # range in the z direction (Input)

# Generate 3D grid of points using numpy
x = np.linspace(0, x_range, x_count)
y = np.linspace(0, y_range, y_count)
z = np.linspace(0, z_range, z_count)
xx, yy, zz = np.meshgrid(x, y, z)
points = np.vstack([xx.ravel(), yy.ravel(), zz.ravel()]).T

# Convert numpy array to list of Rhino.Geometry.Point3d
points = [rg.Point3d(*pt) for pt in points]

# Output
a = points  # Connect this to an output node in Grasshopper
# ---------- end tensors_3 ----------
entwine = Entwine(Branch00=geometry, Branch01=panel_3, FlattenInputs=True)  # disabled
geometry_2 = Geometry(tensors_2.a)
panel_5 = Panel()  # disabled
geometry_3 = Geometry(tensors_2.b)
geometry_4 = Geometry(tensors_3.a)  # disabled
# Becoming a Data Scientist
# with Python in Grasshopper
# at Wickerson Studios
# 001 Mathematics
# gpt-4 Initial Response
# Creating a geometric 3D model using linear
# algebra, tensors, and the Python 3 script node
# in Grasshopper for Rhino 8 WIP involves
# multiple steps. Below is a guideline on how to do
#  it:
# 
# Install Required Libraries: Make sure you have
# the Rhino 8 WIP, Grasshopper, and the
# required Python libraries installed.
# 
# Understanding RhinoCommon API:
# RhinoCommon is the .NET SDK for Rhino 5 and
#  Rhino 6. It provides the ability to access and
# manipulate the geometry and document
# structure of Rhino.
# 
# Python 3 Node in Grasshopper: Grasshopper is
# a visual programming environment that runs
# inside the Rhino application. You can use the
# Python 3 node in Grasshopper to run your
# Python scripts.
panel_6 = Panel(entwine)  # disabled
panel_7 = Panel(tensors_2.out)
panel_8 = Panel(tensors_3.out)  # disabled
entwine_2 = Entwine(Branch00=geometry_2, Branch01=geometry_3, FlattenInputs=True)
# gpt-4 Initial Response
# Certainly! Below is a more complex example that
# creates multiple layers of geometry based on
# complex trigonometric polynomials and utilizes
# NumPy. This script outputs both the original
# sphere and a new set of 3D points based
# oncomplex polynomial calculations.
# 
# Here's how the code works:
# 
# We still create a base sphere as before.
# Then we create a more complex 3D point set
# based on trigonometric polynomials.
# The colors of the 3D point set are also more
# complexly generated.
entwine_3 = Entwine(Branch00=geometry_4, Branch01=panel_5, FlattenInputs=True)  # disabled
panel_9 = Panel(entwine_2)
panel_10 = Panel(entwine_3)  # disabled
