# Grasshopper definition A_008_Jacobian_Matrix.gh (Grasshopper 1.0.7)
# plug-ins: RhinoCodePluginGH

# ----
# Oscillation Algorithm
# The oscillation algorithm can be use to animate
# any geometry that is driven by a number sliders.
# Simply swap out the number sliders at the
# multiplication node in the oscillation script.
panel = Panel("1")  # disabled
trigger = Trigger(Interval=20, TimerInterval=20, Target=data_recorder)  # disabled
data_recorder = DataRecorder(panel, DataLimit=-10, RecordData=False)  # disabled
number_slider = Slider(15, range=0..1000)  # disabled
list_length = ListLength(List=data_recorder)  # disabled
division = Division(A=list_length, B=number_slider)  # disabled
cosine = Cosine(Value=division)  # disabled
sine = Sine(Value=division)  # disabled
panel_2 = Panel([sine, cosine])  # disabled

multiplication = Multiplication(A=sine)  # disabled
multiplication_2 = Multiplication(A=cosine)  # disabled
# ADVANCED
number_slider_2 = Slider(10, range=0..10)
number_slider_3 = Slider(6.36, range=0..10)  # disabled
number_slider_4 = Slider(2.11, range=0..10)  # disabled
# 2nd gpt-4 Text Prompt
# Great, now make the script much more complex model
# with complex trigonometric polynomials and the
# NUMPY python library. Be sure to incorporate the previous code logic.
# ensure that this script produces 3d geometry as
# well for Data visualization purposes.
number_slider_5 = Slider(-1.21, range=-10..10.01)  # disabled
# PARAMETRIC
number_slider_6 = Slider(6.22, range=0..10)  # disabled
# BASIC
jacobian_matrix = Script()  # -> out, a; disabled
# ---------- jacobian_matrix: Python ----------
import Rhino.Geometry as rg
import numpy as np

def func(x, y, z):
    # A function from R^3 to R^3
    return np.array([
        x + 2*y - z,
        y - z**2,
        z + x*y
    ])

def jacobian(x, y, z):
    # The Jacobian matrix of the func at (x, y, z)
    return np.array([
        [1, 2, -1],
        [0, 1, -2*z],
        [y, x, 1]
    ])

def create_twisted_box():
    # Create the vertices of the box
    vertices = [
        rg.Point3d(0, 0, 0),
        rg.Point3d(1, 0, 0),
        rg.Point3d(1, 1, 0),
        rg.Point3d(0, 1, 0),
        rg.Point3d(0, 0, 1),
        rg.Point3d(1, 0, 1),
        rg.Point3d(1, 1, 1),
        rg.Point3d(0, 1, 1)
    ]
    
    # Twist the vertices using the func and the Jacobian matrix
    for i in range(len(vertices)):
        pt = vertices[i]
        x, y, z = pt.X, pt.Y, pt.Z  # Unpack coordinates here
        J = jacobian(x, y, z)
        detJ = np.linalg.det(J)
        
        if detJ != 0:
            J_inv = np.linalg.inv(J)
            f = func(x, y, z)
            delta = np.dot(J_inv, f)
            vertices[i] = rg.Point3d(x + delta[0], y + delta[1], z + delta[2])
    
    # Create the box from the twisted vertices
    box = rg.BoundingBox(vertices)
    
    return box

# Create the twisted box
box = create_twisted_box()

# Output the box
a = box
# ---------- end jacobian_matrix ----------
geometry = Geometry(jacobian_matrix.a)  # disabled
# Becoming a Data Scientist
# with Python in Grasshopper
# at Wickerson Studios
# 001 Mathematics
# 001 LINEAR ALGEBRA
# 008 Jacobian Matrix
# gpt-4 Text Prompt
# Create a geometric 3D model with
# 
# Mathematics
# 
# LINEAR ALGEBRA
# 
# Jacobian Matrix
# 
# 
# in python 3 code for the python 3 script
# node in grasshopper for Rhino8WIP using the
# 
# Rhino Common API to create some geometry as well.
# 
# Output the parts of the model in different
# variable outputs in the python 3 node in
# grasshopper.
panel_3 = Panel(jacobian_matrix.out)  # disabled
jacobian_matrix_2 = Script(
    x_len=number_slider_2,
    y_len=Slider(10, range=0..10),
    z_len=Slider(0.04, range=-10..10.01),
    twist_factor=Slider(-1.21, range=-10..10.01),
    x_res=Slider(5, range=0..10),
    y_res=Slider(4, range=0..10))  # -> out, a; inputs x_len: Double, y_len: Double, z_len: Double, twist_factor: Double, x_res: Int32, y_res: Int32
# ---------- jacobian_matrix_2: Python ----------
import Rhino.Geometry as rg
import numpy as np
import math

def func(x, y, z, twist_factor):
    return np.array([
        x + 2 * y - twist_factor * math.sin(z),
        y - math.cos(x) * z ** 2,
        z + math.sin(x * y)
    ])

def jacobian(x, y, z, twist_factor):
    return np.array([
        [1, 2, -twist_factor * math.cos(z)],
        [math.sin(x) * z ** 2, 1, -2 * z * math.sin(x)],
        [y * math.cos(x * y), x * math.cos(x * y), 1]
    ])

def create_twisted_surface(x_len, y_len, z_len, twist_factor, x_res, y_res):
    points_flat_list = []
    
    for i in range(x_res):
        for j in range(y_res):
            x = i * (x_len / (x_res - 1))
            y = j * (y_len / (y_res - 1))
            z = math.sin(x) * math.cos(y) * z_len
            pt = rg.Point3d(x, y, z)
            
            J = jacobian(x, y, z, twist_factor)
            detJ = np.linalg.det(J)
            
            if abs(detJ) > 1e-5:  # Near-zero determinants can be problematic
                J_inv = np.linalg.inv(J)
                f = func(x, y, z, twist_factor)
                delta = np.dot(J_inv, f)
                pt = rg.Point3d(pt.X + delta[0], pt.Y + delta[1], pt.Z + delta[2])

            points_flat_list.append(pt)
    
    return rg.NurbsSurface.CreateFromPoints(points_flat_list, x_res, y_res, 3, 3)

# Replace these with input parameters from Grasshopper
"""
x_len = 5.0
y_len = 5.0
z_len = 1.0
twist_factor = 1.0
x_res = 10
y_res = 10
"""

# Create and output the twisted surface
twisted_surface = create_twisted_surface(x_len, y_len, z_len, twist_factor, x_res, y_res)
a = twisted_surface
# ---------- end jacobian_matrix_2 ----------
jacobian_matrix_3 = Script(x_len=number_slider_6, y_len=number_slider_3, z_len=number_slider_4, twist_factor=number_slider_5)  # -> out, a; inputs x_len: Double, y_len: Double, z_len: Double, twist_factor: Double; disabled
# ---------- jacobian_matrix_3: Python ----------
import Rhino.Geometry as rg
import numpy as np

def func(x, y, z, twist_factor):
    # A function from R^3 to R^3
    return np.array([
        x + 2*y - twist_factor * z,
        y - z**2,
        z + x*y
    ])

def jacobian(x, y, z, twist_factor):
    # The Jacobian matrix of the func at (x, y, z)
    return np.array([
        [1, 2, -twist_factor],
        [0, 1, -2*z],
        [y, x, 1]
    ])

def create_twisted_box(x_len, y_len, z_len, twist_factor):
    # Create the vertices of the box
    vertices = [
        rg.Point3d(0, 0, 0),
        rg.Point3d(x_len, 0, 0),
        rg.Point3d(x_len, y_len, 0),
        rg.Point3d(0, y_len, 0),
        rg.Point3d(0, 0, z_len),
        rg.Point3d(x_len, 0, z_len),
        rg.Point3d(x_len, y_len, z_len),
        rg.Point3d(0, y_len, z_len)
    ]
    
    # Twist the vertices using the func and the Jacobian matrix
    for i in range(len(vertices)):
        pt = vertices[i]
        x, y, z = pt.X, pt.Y, pt.Z  # Unpack coordinates here
        J = jacobian(x, y, z, twist_factor)
        detJ = np.linalg.det(J)
        
        if detJ != 0:
            J_inv = np.linalg.inv(J)
            f = func(x, y, z, twist_factor)
            delta = np.dot(J_inv, f)
            vertices[i] = rg.Point3d(x + delta[0], y + delta[1], z + delta[2])
    
    # Create the box from the twisted vertices
    box = rg.BoundingBox(vertices)
    
    return box

# Replace these with input parameters from Grasshopper
"""
x_len = 1.0 # Length along X-axis
y_len = 1.0 # Length along Y-axis
z_len = 1.0 # Length along Z-axis
twist_factor = 1.0 # Factor by which to twist the geometry
"""

# Create the twisted box
box = create_twisted_box(x_len, y_len, z_len, twist_factor)

# Output the box
a = box
# ---------- end jacobian_matrix_3 ----------
entwine = Entwine(Branch00=geometry, FlattenInputs=True)  # disabled
# gpt-4 Initial Response
# Creating a 3D geometric model using Python,
# linear algebra, and the Rhino Common API in
# Grasshopper for Rhino 8 WIP involves several
# steps.
# 
# Here is a basic example of a Python script that
# demonstrates the use of Jacobian matrix in
# creating a 3D geometry using Rhino Common
# API. This script will create a twisted box-like
# structure and will use the Jacobian matrix to
# adjust the positions of its vertices.
panel_4 = Panel(entwine)  # disabled
geometry_2 = Geometry(jacobian_matrix_2.a)
geometry_3 = Geometry(jacobian_matrix_3.a)  # disabled
panel_5 = Panel(jacobian_matrix_2.out)
panel_6 = Panel(jacobian_matrix_3.out)  # disabled
entwine_2 = Entwine(Branch00=geometry_2, FlattenInputs=True)
entwine_3 = Entwine(Branch00=geometry_3, FlattenInputs=True)  # disabled
panel_7 = Panel(entwine_2)
# gpt-4 Initial Response
# Certainly! Creating a more complex 3D geometry
#  with trigonometric polynomials and utilizing the
# NumPy library can make the model more
# interesting for data visualization purposes.
# 
# Let's assume we want to create a sort of
# "twisted surface" based on trigonometric
# polynomials and then evaluate its Jacobian
# matrix to further twist it.
panel_8 = Panel(entwine_3)  # disabled
