# Grasshopper definition A_009_Curse_of_Dimensionality.gh (Grasshopper 1.0.7)
# plug-ins: RhinoCodePluginGH

# ----
# Oscillation Algorithm
# The oscillation algorithm can be use to animate
# any geometry that is driven by a number sliders.
# Simply swap out the number sliders at the
# multiplication node in the oscillation script.
panel = Panel("1")  # disabled
trigger = Trigger(Interval=20, TimerInterval=20, Target=data_recorder)  # disabled
data_recorder = DataRecorder(panel, DataLimit=-10, RecordData=False)  # disabled
number_slider = Slider(15, range=0..1000)  # disabled
list_length = ListLength(List=data_recorder)  # disabled
division = Division(A=list_length, B=number_slider)  # disabled
cosine = Cosine(Value=division)  # disabled
sine = Sine(Value=division)  # disabled
panel_2 = Panel([sine, cosine])  # disabled

multiplication = Multiplication(A=sine)  # disabled
multiplication_2 = Multiplication(A=cosine)  # disabled
# PARAMETRIC
number_slider_2 = Slider(35, range=0..1000)  # disabled
number_slider_3 = Slider(3, range=3..5)  # disabled
number_slider_4 = Slider(3.99, range=0..10)  # disabled
number_slider_5 = Slider(4.95, range=0..10)  # disabled
number_slider_6 = Slider(2.75, range=0..10)  # disabled
# Create a geometric 3D model with
# 
# Mathematics
# 
# LINEAR ALGEBRA
# 
# Curse of Dimensionality
# 
# 
# in python 3 code for the python 3 script
# node in grasshopper for Rhino8WIP using the
# 
# Rhino Common API to create some geometry as well.
# 
# Output the parts of the model in different
# variable outputs in the python 3 node in
# grasshopper.
# gpt-4 Initial Response
# BASIC
# I apologize for the inconvenience. In Rhino's
# Python environment, you may not have direct
# access to external Python packages like scikit-
# learn, which is required for performing PCA
# (Principal Component Analysis).
# 
# However, you can implement a simplified version
#  of PCA yourself, directly in Rhino's Python
# environment, which generally has access to
# NumPy. Here is how to do that:
# 
# Open Grasshopper and add a Python script
# component to your workspace.
# Double-click the Python component to open the
#  editor and paste the code below:
curse_of_dimensionality = Script()  # -> out, a; disabled
# ---------- curse_of_dimensionality: Python ----------
import Rhino
import scriptcontext
import numpy as np

# Center the dataset
def center_data(X):
    return X - np.mean(X, axis=0)

# Perform PCA to reduce to 3 dimensions
def pca_reduce_to_3D(X):
    centered_data = center_data(X)
    covariance_matrix = np.cov(centered_data, rowvar=False)
    eigenvalues, eigenvectors = np.linalg.eigh(covariance_matrix)
    sorted_indices = np.argsort(eigenvalues)[::-1]
    top_3_eigenvectors = eigenvectors[:, sorted_indices[:3]]
    return np.dot(centered_data, top_3_eigenvectors)

# Create the geometry
def create_geometry():
    # Generate 50 points in a 100-dimensional space
    high_dim_data = np.random.rand(50, 100)
    
    # Use PCA to project the points to 3D
    projected_data = pca_reduce_to_3D(high_dim_data)
    
    # Create points
    points = []
    for point in projected_data:
        point3d = Rhino.Geometry.Point3d(point[0]*100, point[1]*100, point[2]*100)
        points.append(point3d)
        
    return points

# Output
a = create_geometry()
# ---------- end curse_of_dimensionality ----------
# ADVANCED
curse_of_dimensionality_2 = Script()  # -> out, a; disabled
# ---------- curse_of_dimensionality_2: Python ----------
import Rhino
import scriptcontext
import numpy as np

# Center the dataset
def center_data(X):
    return X - np.mean(X, axis=0)

# Perform PCA to reduce to 3 dimensions
def pca_reduce_to_3D(X):
    centered_data = center_data(X)
    covariance_matrix = np.cov(centered_data, rowvar=False)
    eigenvalues, eigenvectors = np.linalg.eigh(covariance_matrix)
    sorted_indices = np.argsort(eigenvalues)[::-1]
    top_3_eigenvectors = eigenvectors[:, sorted_indices[:3]]
    return np.dot(centered_data, top_3_eigenvectors)

# Generate data with trigonometric polynomials
def generate_complex_data(num_points, num_dimensions):
    X = np.linspace(0, 1, num_points)
    high_dim_data = np.zeros((num_points, num_dimensions))
    
    for dim in range(num_dimensions):
        # Create a complex trigonometric polynomial for each dimension
        trig_poly = np.sin(2 * np.pi * X) + np.cos(4 * np.pi * X) + np.sin(8 * np.pi * X * np.random.rand())
        high_dim_data[:, dim] = trig_poly
    
    return high_dim_data

# Create the geometry
def create_geometry():
    # Generate complex data in a 100-dimensional space
    high_dim_data = generate_complex_data(100, 100)
    
    # Use PCA to project the points to 3D
    projected_data = pca_reduce_to_3D(high_dim_data)
    
    # Create points
    points = []
    for point in projected_data:
        point3d = Rhino.Geometry.Point3d(point[0]*100, point[1]*100, point[2]*100)
        points.append(point3d)
    
    return points

# Output
a = create_geometry()
# ---------- end curse_of_dimensionality_2 ----------
geometry = Geometry(curse_of_dimensionality_2.a)  # disabled
# PARAMETRIC
# 2nd gpt-4 Text Prompt
# Great, now make the script much more complex model
# with complex trigonometric polynomials and the
# NUMPY python library. Be sure to incorporate the previous code logic.
# ensure that this script produces 3d geometry as
# well for Data visualization purposes.
geometry_2 = Geometry(curse_of_dimensionality.a)  # disabled
# 001 Mathematics
# 001 LINEAR ALGEBRA
# 009 Curse of Dimensionality
# gpt-4 Text Prompt
panel_3 = Panel(curse_of_dimensionality.out)  # disabled
panel_4 = Panel(curse_of_dimensionality_2.out)  # disabled
entwine = Entwine(Branch00=geometry, FlattenInputs=True)  # disabled
curse_of_dimensionality_3 = Script(
    num_points=number_slider_2,
    num_dimensions=number_slider_3,
    freq1=number_slider_4,
    freq2=number_slider_5,
    freq3=number_slider_6)  # -> out, a; inputs num_points: Int32, num_dimensions: Int32, freq1: Double, freq2: Double, freq3: Double; disabled
# ---------- curse_of_dimensionality_3: Python ----------
import Rhino
import scriptcontext
import numpy as np

# Number of points
#num_points = x  # Replace 'x' with a Grasshopper slider or input

# Number of dimensions
#num_dimensions = y  # Replace 'y' with a Grasshopper slider or input

# Frequencies for trigonometric functions
#freq1, freq2, freq3 = p, q, r  # Replace 'p', 'q', 'r' with Grasshopper sliders or inputs

# Center the dataset
def center_data(X):
    return X - np.mean(X, axis=0)

# Perform PCA to reduce to 3 dimensions
def pca_reduce_to_3D(X):
    centered_data = center_data(X)
    covariance_matrix = np.cov(centered_data, rowvar=False)
    eigenvalues, eigenvectors = np.linalg.eigh(covariance_matrix)
    sorted_indices = np.argsort(eigenvalues)[::-1]
    top_3_eigenvectors = eigenvectors[:, sorted_indices[:3]]
    return np.dot(centered_data, top_3_eigenvectors)

# Generate data with trigonometric polynomials
def generate_complex_data():
    X = np.linspace(0, 1, num_points)
    high_dim_data = np.zeros((num_points, num_dimensions))
    
    for dim in range(num_dimensions):
        trig_poly = np.sin(freq1 * np.pi * X) + np.cos(freq2 * np.pi * X) + np.sin(freq3 * np.pi * X)
        high_dim_data[:, dim] = trig_poly
    
    return high_dim_data

# Create the geometry
def create_geometry():
    high_dim_data = generate_complex_data()
    projected_data = pca_reduce_to_3D(high_dim_data)
    
    points = []
    for point in projected_data:
        point3d = Rhino.Geometry.Point3d(point[0]*100, point[1]*100, point[2]*100)
        points.append(point3d)
    
    return points

# Output
a = create_geometry()
# ---------- end curse_of_dimensionality_3 ----------
curse_of_dimensionality_4 = Script(
    num_points=Slider(41, range=0..1000),
    num_dimensions=Slider(3, range=3..5),
    max_terms=Slider(2, range=0..10),
    freq1=Slider(5.09, range=0..10),
    freq2=Slider(4.22, range=0..10),
    freq3=Slider(1.65, range=0..10))  # -> out, a; inputs num_points: Int32, num_dimensions: Int32, max_terms: Int32, freq1: Double, freq2: Double, freq3: Double
# ---------- curse_of_dimensionality_4: Python ----------
import Rhino
import scriptcontext
import numpy as np
import random

# Number of points
#num_points = x  # Controlled by a Grasshopper slider

# Number of dimensions
#num_dimensions = y  # Controlled by a Grasshopper slider

# Maximum number of terms in the trigonometric polynomial
#max_terms = z  # Controlled by a Grasshopper slider

# Center the dataset
def center_data(X):
    return X - np.mean(X, axis=0)

# Perform PCA to reduce to 3 dimensions
def pca_reduce_to_3D(X):
    centered_data = center_data(X)
    covariance_matrix = np.cov(centered_data, rowvar=False)
    eigenvalues, eigenvectors = np.linalg.eigh(covariance_matrix)
    sorted_indices = np.argsort(eigenvalues)[::-1]
    top_3_eigenvectors = eigenvectors[:, sorted_indices[:3]]
    return np.dot(centered_data, top_3_eigenvectors)

# Generate data with complex trigonometric polynomials
def generate_complex_data():
    X = np.linspace(0, 1, num_points)
    high_dim_data = np.zeros((num_points, num_dimensions))

    for dim in range(num_dimensions):
        trig_poly = np.zeros_like(X)
        for term in range(random.randint(1, max_terms)):
            freq = random.uniform(1, 10)
            phase = random.uniform(0, np.pi)
            coeff = random.uniform(1, 5)
            trig_poly += coeff * (np.sin(freq * np.pi * X + phase) + np.cos(freq * np.pi * X + phase))
        
        high_dim_data[:, dim] = trig_poly
    
    return high_dim_data

# Create the geometry
def create_geometry():
    high_dim_data = generate_complex_data()
    projected_data = pca_reduce_to_3D(high_dim_data)
    
    points = []
    for point in projected_data:
        point3d = Rhino.Geometry.Point3d(point[0]*100, point[1]*100, point[2]*100)
        points.append(point3d)
    
    return points

# Output
a = create_geometry()
# ---------- end curse_of_dimensionality_4 ----------
entwine_2 = Entwine(Branch00=geometry_2, FlattenInputs=True)  # disabled
# gpt-4 Initial Response
# Certainly! In the following example, I've built
# upon the previous script to create a more
# complex 3D model. The model consists of points
#  whose positions are influenced by trigonometric
#  polynomials. This is used to simulate a
# "distorted" high-dimensional space, which is
# then projected back into 3D using PCA as before.
# 
# The trigonometric polynomials can be thought of
#  as complex transformations in the high-
# dimensional space. We'll generate the data with
#  trigonometric polynomials in 100 dimensions
# and then visualize the PCA projection in 3D.
panel_5 = Panel(entwine)  # disabled
# Becoming a Data Scientist
# with Python in Grasshopper
# at Wickerson Studios
# gpt-4 Initial Response
# The Curse of Dimensionality is a challenge in
# machine learning, statistics, and data science,
# but it's not inherently a geometrical concept. In
# 3D modeling or computer graphics, you're
# typically working in a low-dimensional space
# (e.g., 3D space) so the Curse of Dimensionality
# is not as directly applicable.
# 
# However, to connect the concept of the Curse
# of Dimensionality to geometry, let's consider a
# hypothetical scenario. Let's say you are
# modeling a complex geometric object that has a
# multi-dimensional set of parameters or features.
#  As the dimensionality of this feature space
# increases, the computational complexity and the
#  amount of data required to make accurate
# predictions or representations also increases
# exponentially.
# 
# Here's an example in Python to create a
# Grasshopper node that would illustrate the
# concept by plotting points in a high-dimensional
# space and projecting them down to 3D.
# 
# For the sake of this example, let's use
# RhinoCommon to create points in a 100-
# dimensional space and then use PCA (Principal
# Component Analysis) to project those points
# back into 3D space. The distance relations
# among these points should show how the Curse
#  of Dimensionality makes it difficult to capture
# the true relationships in lower dimensions.
panel_6 = Panel(entwine_2)  # disabled
geometry_3 = Geometry(curse_of_dimensionality_3.a)  # disabled
geometry_4 = Geometry(curse_of_dimensionality_4.a)
interpolate = Interpolate(Vertices=geometry_4, Degree=3, Periodic=False, KnotStyle=1)  # -> Curve, Length, Domain
panel_7 = Panel(curse_of_dimensionality_3.out)  # disabled
entwine_3 = Entwine(Branch00=geometry_3, FlattenInputs=True)  # disabled
panel_8 = Panel(curse_of_dimensionality_4.out)
entwine_4 = Entwine(Branch00=geometry_4, FlattenInputs=True)
panel_9 = Panel(entwine_3)  # disabled
panel_10 = Panel(entwine_4)
