# Grasshopper definition B_001_differentiation.gh (Grasshopper 1.0.7)
# plug-ins: RhinoCodePluginGH

# gpt-4 Text Prompt
# Great, now make the script much more complex model
# with complex trigonometric polynomials and the
# NUMPY python library. Be sure to incorporate the previous code logic.
# ensure that this script produces 3d geometry as
# well for Data visualization purposes.
# ADVANCED
number_slider = Slider(19, range=0..100)
number_slider_2 = Slider(3, range=-3..3)  # disabled
number_slider_3 = Slider(0.74, range=-10..10)  # disabled
number_slider_4 = Slider(-0.438, range=-10..10)  # disabled
number_slider_5 = Slider(3.341, range=-10..10)  # disabled
number_slider_6 = Slider(10, range=0..10)  # disabled
# PARAMETRIC
number_slider_7 = Slider(-3, range=-3..3)  # disabled
# BASIC
differentiation = Script()  # -> out, OutCurve, OutTangents; disabled
# ---------- differentiation: Python ----------
import Rhino
import Rhino.Geometry as rg
import math

def f(x):
    return x**2

def df(x):
    return 2*x

# Create a list to store points for the curve
points = []

# Create a list to store lines representing tangents
tangents = []

# Create points and populate the points list
for i in range(-10, 11):
    x = i
    y = f(x)
    z = 0
    points.append(rg.Point3d(x, y, z))

# Create the curve
curve = rg.Curve.CreateInterpolatedCurve(points, 3)

# Generate tangent lines based on the curve
curve_domain = curve.Domain
for i in range(10):
    t = curve_domain.ParameterAt(i / 9.0)
    point_on_curve = curve.PointAt(t)
    tangent_vector = curve.TangentAt(t)
    
    # Modify the tangent_vector based on the derivative
    x = point_on_curve.X
    scale_factor = df(x)
    tangent_vector *= scale_factor
    
    end_point = rg.Point3d.Add(point_on_curve, tangent_vector)
    tangent_line = rg.Line(point_on_curve, end_point)
    tangents.append(tangent_line)

# Output curve and tangents
OutCurve = curve
OutTangents = tangents
# ---------- end differentiation ----------
geometry = Geometry(differentiation.OutCurve)  # disabled
geometry_2 = Geometry(differentiation.OutTangents)  # disabled
# Becoming a Data Scientist
# with Python in Grasshopper
# at Wickerson Studios
# 001 Mathematics
# 002 CALCULUS
# 001 differentiation
# gpt-4 Text Prompt
# Create a geometric 3D model with
# 
# Mathematics
# 
# CALCULUS
# 
# differentiation
# 
# 
# in python 3 code for the python 3 script
# node in grasshopper for Rhino8WIP using the
# 
# Rhino Common API to create some geometry as well.
# 
# Output the parts of the model in different
# variable outputs in the python 3 node in
# grasshopper.
panel = Panel(differentiation.out)  # disabled
differentiation_2 = Script(
    range_min=number_slider_7,
    range_max=number_slider_2,
    a=number_slider_3,
    b=number_slider_4,
    c=number_slider_5,
    num_tangents=number_slider_6)  # -> out, OutCurve, OutTangents; inputs range_min: Int32, range_max: Int32, a: Double, b: Double, c: Double, num_tangents: Int32; disabled
# ---------- differentiation_2: Python ----------
import Rhino
import Rhino.Geometry as rg
import math

# Define the function and its derivative
def f(x, a, b, c):
    return a * x**2 + b * x + c

def df(x, a, b):
    return 2 * a * x + b

# Input parameters:
# a, b, c are coefficients for the function f(x) = a*x^2 + b*x + c
# range_min, range_max define the range of x-values for the curve
# num_tangents is the number of tangent lines to generate

# Create a list to store points for the curve
points = []

# Create a list to store lines representing tangents
tangents = []

# Create points and populate the points list
for i in range(range_min, range_max + 1):
    x = i
    y = f(x, a, b, c)
    z = 0
    points.append(rg.Point3d(x, y, z))

# Create the curve
curve = rg.Curve.CreateInterpolatedCurve(points, 3)

# Generate tangent lines based on the curve
curve_domain = curve.Domain
for i in range(num_tangents):
    t = curve_domain.ParameterAt(i / float(num_tangents-1))
    point_on_curve = curve.PointAt(t)
    tangent_vector = curve.TangentAt(t)
    
    # Modify the tangent_vector based on the derivative
    x = point_on_curve.X
    scale_factor = df(x, a, b)
    tangent_vector *= scale_factor
    
    end_point = rg.Point3d.Add(point_on_curve, tangent_vector)
    tangent_line = rg.Line(point_on_curve, end_point)
    tangents.append(tangent_line)

# Output curve and tangents
OutCurve = curve
OutTangents = tangents
# ---------- end differentiation_2 ----------
differentiation_3 = Script(
    num_points=number_slider,
    range_min=Slider(-10, range=-10..10),
    range_max=Slider(10, range=-10..10),
    a=Slider(-1.844, range=-10..10),
    b=Slider(1.058, range=-10..10),
    c=Slider(2.661, range=-10..10),
    num_tangents=Slider(10, range=0..10))  # -> out, OutSurface, OutTangents; inputs num_points: Int32, range_min: Int32, range_max: Int32, a: Double, b: Double, c: Double, num_tangents: Int32
# ---------- differentiation_3: Python ----------
import Rhino
import Rhino.Geometry as rg
import numpy as np

# Function definition
def f(x, y, a, b, c):
    return np.sin(a * x) + np.cos(b * y) + c

# Gradient definition
def gradient(x, y, a, b):
    df_dx = a * np.cos(a * x)
    df_dy = -b * np.sin(b * y)
    return df_dx, df_dy

# Initialize variables
"""
a = 1  # Coefficient for sine term, connect to a Grasshopper slider
b = 1  # Coefficient for cosine term, connect to a Grasshopper slider
c = 1  # Constant term, connect to a Grasshopper slider
range_min = -10  # Minimum range for x and y, connect to a Grasshopper slider
range_max = 10  # Maximum range for x and y, connect to a Grasshopper slider
num_points = 20  # Number of points along x and y, connect to a Grasshopper slider
"""

# Initialize lists for storing surface points and tangent lines
surface_points = []
tangent_lines = []

# Create surface points and tangent lines
x_values = np.linspace(range_min, range_max, num_points)
y_values = np.linspace(range_min, range_max, num_points)

for x in x_values:
    for y in y_values:
        z = f(x, y, a, b, c)
        point = rg.Point3d(x, y, z)
        surface_points.append(point)
        
        df_dx, df_dy = gradient(x, y, a, b)
        tangent_vector = rg.Vector3d(df_dx, df_dy, 1)
        tangent_end = point + tangent_vector
        tangent_line = rg.Line(point, tangent_end)
        tangent_lines.append(tangent_line)

# Create NURBS surface from points
if len(surface_points) > 0:
    u_count = num_points  # Number of points in U direction
    v_count = num_points  # Number of points in V direction
    surface = rg.NurbsSurface.CreateFromPoints(surface_points, u_count, v_count, 3, 3)

# Output
if surface:
    OutSurface = surface
else:
    OutSurface = "Failed to create surface"

if tangent_lines:
    OutTangents = tangent_lines
else:
    OutTangents = "Failed to create tangents"
# ---------- end differentiation_3 ----------
entwine = Entwine(Branch00=geometry, Branch01=geometry_2, FlattenInputs=True)  # disabled
geometry_3 = Geometry(differentiation_2.OutCurve)  # disabled
geometry_4 = Geometry(differentiation_2.OutTangents)  # disabled
geometry_5 = Geometry(differentiation_3.OutSurface)
geometry_6 = Geometry(differentiation_3.OutTangents)
# gpt-4 Initial Response
# Creating a geometric 3D model in Rhino using
# Python requires RhinoCommon, Rhino's API for
# Python. The following code snippet generates a
# basic example that also incorporates calculus
# (differentiation) to modify the geometry. In this
# example, we'll generate a curve and use the
# derivative at various points along the curve to
# create lines that represent the tangents at
# those points.
# 
# First, you'll need to have Rhino and
# Grasshopper installed, and you need to be able
# to run a Python 3 script in a Python 3
# component in Grasshopper.
panel_2 = Panel(entwine)  # disabled
panel_3 = Panel(differentiation_2.out)  # disabled
panel_4 = Panel(differentiation_3.out)
entwine_2 = Entwine(Branch00=geometry_3, Branch01=geometry_4, FlattenInputs=True)  # disabled
entwine_3 = Entwine(Branch00=geometry_5, Branch01=geometry_6, FlattenInputs=True)
# gpt-4 Initial Response
# To make the curve and its tangent lines parametric, you can add input parameters to the
# Python script node in Grasshopper. This way, you can control aspects like the range of x-values,
# coefficients of the equation, or the number of tangent lines. Below is a modified version of the
# Python script that accepts such parameters.
# 
# Let's say you want to make a parametric curve
# f(x)=a∗x ^2
#  +b∗x+c and its tangents. The code below takes a, b, c, range_min, range_max, and
# num_tangents as input parameters:
panel_5 = Panel(entwine_2)  # disabled
# gpt-4 Initial Response
# Certainly! To create a more complex geometric model in 3D, let's consider a function of two variables,
# 
# f(x,y), which is a complex trigonometric polynomial. The curve will now be a surface in 3D space.
# 
# For this example, let's define
# 
# f(x,y)=sin(ax)+cos(by)+c as the function, and
# 
# ∇f=⟨acos(ax),−bsin(by)⟩ as its gradient (used to generate vectors tangent to the surface).
# 
# Here's the Python 3 script for Grasshopper using the RhinoCommon API and NumPy.
# Note that you'll need to ensure that the NumPy library is available in your Rhino Python
panel_6 = Panel(entwine_3)
