# Grasshopper definition B_002_integration.gh (Grasshopper 1.0.7)
# plug-ins: RhinoCodePluginGH

# PARAMETRIC
number_slider = Slider(-10, range=-10..10)  # disabled
# gpt-4 Text Prompt
# Great, now make the script much more complex model
# with complex trigonometric polynomials and the
# NUMPY python library. Be sure to incorporate the previous code logic.
# ensure that this script produces 3d geometry as
# well for Data visualization purposes.
number_slider_2 = Slider(4.733, range=-10..10)  # disabled
number_slider_3 = Slider(10, range=-10..10)  # disabled
number_slider_4 = Slider(-10, range=-10..10)  # disabled
number_slider_5 = Slider(1, range=0..10)  # disabled
number_slider_6 = Slider(10, range=-10..10)  # disabled
number_slider_7 = Slider(1, range=0..10)  # disabled
# BASIC
integration = Script()  # -> out, base_pts, crvs, srf; disabled
# ---------- integration: Python ----------
import Rhino.Geometry as rg
import math

# Function that represents the height z of the surface at (x, y)
def f(x, y):
    return math.sin(math.sqrt(x**2 + y**2))

# Discretize the domain
x_values = [i for i in range(-10, 11)]  # from -10 to 10
y_values = [i for i in range(-10, 11)]  # from -10 to 10

# Initialize lists to store geometry
base_points = []  # To store base points
curves = []  # To store curves

# Generate base points and curves
for x in x_values:
    curve_points = []
    for y in y_values:
        z = f(x, y)  # Calculate the z-coordinate using the function f(x, y)
        pt = rg.Point3d(x, y, z)  # Create a 3D point
        curve_points.append(pt)
        base_points.append(pt)  # Add the point to the base_points list
    curve = rg.PolylineCurve(curve_points)  # Create a PolylineCurve from the list of points
    curves.append(curve)  # Add the curve to the curves list

# Generate the surface by lofting the curves
if len(curves) > 1:
    lofted_srf = rg.Brep.CreateFromLoft(curves, rg.Point3d.Unset, rg.Point3d.Unset, rg.LoftType.Normal, False)
else:
    lofted_srf = None

# Output the geometry
# Assuming you have 3 outputs in the Python node named 'base_pts', 'crvs', and 'srf'
base_pts = base_points  # These are the base points
crvs = curves  # These are the curves
srf = lofted_srf  # This is the lofted surface
# ---------- end integration ----------
# ADVANCED
number_slider_8 = Slider(-10, range=-10..10)
geometry = Geometry(integration.base_pts)  # disabled
geometry_2 = Geometry(integration.crvs)  # disabled
geometry_3 = Geometry(integration.srf)  # disabled
# Becoming a Data Scientist
# with Python in Grasshopper
# at Wickerson Studios
# 001 Mathematics
# 002 CALCULUS
# 002 integration
# gpt-4 Text Prompt
# Create a geometric 3D model with
# 
# Mathematics
# 
# CALCULUS
# 
# integration
# 
# 
# in python 3 code for the python 3 script
# node in grasshopper for Rhino8WIP using the
# 
# Rhino Common API to create some geometry as well.
# 
# Output the parts of the model in different
# variable outputs in the python 3 node in
# grasshopper.
panel = Panel(integration.out)  # disabled
integration_2 = Script(
    xmin=number_slider,
    xmax=number_slider_3,
    ymin=number_slider_4,
    ymax=number_slider_6,
    xstep=number_slider_5,
    ystep=number_slider_7,
    amplitude=number_slider_2)  # -> out, base_pts, crvs, srf; inputs xmin: Int32, xmax: Int32, ymin: Int32, ymax: Int32, xstep: Int32, ystep: Int32, amplitude: Double; disabled
# ---------- integration_2: Python ----------
import Rhino.Geometry as rg
import math

# Function that represents the height z of the surface at (x, y)
def f(x, y, amplitude):
    return amplitude * math.sin(math.sqrt(x**2 + y**2))

# Check if parameters are set; if not, set to default values
if "xmin" not in globals():
    xmin = -10
if "xmax" not in globals():
    xmax = 10
if "ymin" not in globals():
    ymin = -10
if "ymax" not in globals():
    ymax = 10
if "xstep" not in globals():
    xstep = 1
if "ystep" not in globals():
    ystep = 1
if "amplitude" not in globals():
    amplitude = 1.0

# Discretize the domain
x_values = [i for i in range(xmin, xmax + 1, xstep)]  # from xmin to xmax
y_values = [i for i in range(ymin, ymax + 1, ystep)]  # from ymin to ymax

# Initialize lists to store geometry
base_points = []  # To store base points
curves = []  # To store curves

# Generate base points and curves
for x in x_values:
    curve_points = []
    for y in y_values:
        z = f(x, y, amplitude)  # Calculate the z-coordinate using the function f(x, y)
        pt = rg.Point3d(x, y, z)  # Create a 3D point
        curve_points.append(pt)
        base_points.append(pt)  # Add the point to the base_points list
    curve = rg.PolylineCurve(curve_points)  # Create a PolylineCurve from the list of points
    curves.append(curve)  # Add the curve to the curves list

# Generate the surface by lofting the curves
if len(curves) > 1:
    lofted_srf = rg.Brep.CreateFromLoft(curves, rg.Point3d.Unset, rg.Point3d.Unset, rg.LoftType.Normal, False)
else:
    lofted_srf = None

# Output the geometry
# Assuming you have 3 outputs in the Python node named 'base_pts', 'crvs', and 'srf'
base_pts = base_points  # These are the base points
crvs = curves  # These are the curves
srf = lofted_srf  # This is the lofted surface
# ---------- end integration_2 ----------
integration_3 = Script(
    xmin=number_slider_8,
    xmax=Slider(10, range=-10..10),
    ymin=Slider(-10, range=-10..10),
    ymax=Slider(10, range=-10..10),
    xstep=Slider(2, range=0..10),
    ystep=Slider(2, range=0..10),
    amplitude=Slider(2.983, range=-10..10),
    frequency=Slider(-0.663, range=-2..2))  # -> out, base_pts, crvs, srf; inputs xmin: Int32, xmax: Int32, ymin: Int32, ymax: Int32, xstep: Int32, ystep: Int32, amplitude: Double, frequency: Double
# ---------- integration_3: Python ----------
import Rhino.Geometry as rg
import numpy as np

# Complex trigonometric polynomial
def f(x, y, amplitude, frequency):
    return amplitude * (np.sin(frequency * np.sqrt(x**2 + y**2)) + np.cos(frequency * x) * np.sin(frequency * y))

# Check if parameters are set; if not, set to default values
if "xmin" not in globals():
    xmin = -10
if "xmax" not in globals():
    xmax = 10
if "ymin" not in globals():
    ymin = -10
if "ymax" not in globals():
    ymax = 10
if "xstep" not in globals():
    xstep = 1
if "ystep" not in globals():
    ystep = 1
if "amplitude" not in globals():
    amplitude = 1.0
if "frequency" not in globals():
    frequency = 1.0

# Discretize the domain
x_values = np.arange(xmin, xmax + 1, xstep)
y_values = np.arange(ymin, ymax + 1, ystep)

# Initialize lists to store geometry
base_points = []  # To store base points
curves = []  # To store curves

# Generate base points and curves
for x in x_values:
    curve_points = []
    for y in y_values:
        z = f(x, y, amplitude, frequency)  # Calculate the z-coordinate using the function f(x, y)
        pt = rg.Point3d(float(x), float(y), float(z))  # Create a 3D point
        curve_points.append(pt)
        base_points.append(pt)  # Add the point to the base_points list
    curve = rg.PolylineCurve(curve_points)  # Create a PolylineCurve from the list of points
    curves.append(curve)  # Add the curve to the curves list

# Generate the surface by lofting the curves
if len(curves) > 1:
    lofted_srf = rg.Brep.CreateFromLoft(curves, rg.Point3d.Unset, rg.Point3d.Unset, rg.LoftType.Normal, False)
else:
    lofted_srf = None

# Output the geometry
# Assuming you have 3 outputs in the Python node named 'base_pts', 'crvs', and 'srf'
base_pts = base_points  # These are the base points
crvs = curves  # These are the curves
srf = lofted_srf  # This is the lofted surface
# ---------- end integration_3 ----------
entwine = Entwine(Branch00=geometry, Branch01=geometry_2, Branch02=geometry_3, FlattenInputs=True)  # disabled
# gpt-4 Initial Response
# Creating a 3D model with calculus integration
# involved in Python for Grasshopper in Rhino 8
# requires several specific components.
# Grasshopper has a built-in Python script editor
# that allows you to use Python with the Rhino
# Common API to create complex geometries.
# 
# In this example, I will create a 3D sine wave
# surface to demonstrate how calculus and
# integration can be utilized. You'll need to add
# this script to a Python 3 component in your
# Grasshopper canvas. The model will have three
# different parts: base points, curves, and a lofted
# surface.
panel_2 = Panel(entwine)  # disabled
geometry_4 = Geometry(integration_2.base_pts)  # disabled
geometry_5 = Geometry(integration_2.crvs)  # disabled
geometry_6 = Geometry(integration_2.srf)  # disabled
panel_3 = Panel(integration_2.out)  # disabled
geometry_7 = Geometry(integration_3.base_pts)
geometry_8 = Geometry(integration_3.crvs)
geometry_9 = Geometry(integration_3.srf)
panel_4 = Panel(integration_3.out)
# gpt-4 Initial Response
entwine_2 = Entwine(Branch00=geometry_4, Branch01=geometry_5, Branch02=geometry_6, FlattenInputs=True)  # disabled
entwine_3 = Entwine(Branch00=geometry_7, Branch01=geometry_8, Branch02=geometry_9, FlattenInputs=True)
panel_5 = Panel(entwine_2)  # disabled
# To create a more complex model using
# trigonometric polynomials and NumPy, we can
# modify the function f(x, y) to use more complex
# trigonometric operations. The NumPy library
# makes it easier to handle array operations and
# mathematical functions.
# 
# Below is a Python script that you can add to
# your Grasshopper Python 3 component. This
# script uses NumPy to calculate the Z-values in a
# more efficient manner, and it employs a complex
#  trigonometric polynomial for f(x, y).
panel_6 = Panel(entwine_3)
