# Grasshopper definition B_003_limits.gh (Grasshopper 1.0.7)
# plug-ins: RhinoCodePluginGH

number_slider = Slider(-10, range=-10..10.01)  # disabled
number_slider_2 = Slider(10, range=0..10)  # disabled
# gpt-4 Text Prompt
# Great, now make the script much more complex model
# with complex trigonometric polynomials and the
# NUMPY python library. Be sure to incorporate the previous code logic.
# ensure that this script produces 3d geometry as
# well for Data visualization purposes.
number_slider_3 = Slider(100, range=0..100)  # disabled
number_slider_4 = Slider(100, range=0..100)  # disabled
# PARAMETRIC
number_slider_5 = Slider(4.23, range=0..10)  # disabled
# ADVANCED
number_slider_6 = Slider(-10, range=-10..10.01)
# BASIC
limits = Script()  # -> out, a, b; disabled
# ---------- limits: Python ----------
import Rhino
import Rhino.Geometry as rg
import math
import numpy as np

def calculate_curve(x):
    # Using numpy to simulate the limit
    n = 1000  # Choose a sufficiently large n for limit approximation
    s = np.linspace(1, n, n)
    y = np.sum(np.sin((s / n) * x)) / n
    return y

# Create an empty list to store the points
curve_points = []

# Create an empty list to store the geometry for output
output_geometry = []

# Generate the curve by looping through x-values from -10 to 10
for x in np.linspace(-10, 10, 500):
    y = calculate_curve(x)
    z = 0  # Let's assume the curve is in the xy-plane
    point = rg.Point3d(x, y, z)
    curve_points.append(point)

# Create a curve from the points
curve = rg.Curve.CreateInterpolatedCurve(curve_points, 3)
if curve:
    output_geometry.append(curve)

# Create a sphere at the start of the curve
start_sphere = rg.Sphere(curve.PointAtStart, 1)
output_geometry.append(start_sphere.ToBrep())  # Convert sphere to Brep for compatibility

# Output the geometry
a = output_geometry
b = curve.GetLength()
# ---------- end limits ----------
geometry = Geometry(limits.a)  # disabled
number = Number(limits.b)  # disabled
# Becoming a Data Scientist
# with Python in Grasshopper
# at Wickerson Studios
# 001 Mathematics
# 002 CALCULUS
# 003 limits
# gpt-4 Text Prompt
# Create a geometric 3D model with
# 
# Mathematics
# 
# CALCULUS
# 
# limits
# 
# 
# in python 3 code for the python 3 script
# node in grasshopper for Rhino8WIP using the
# 
# Rhino Common API to create some geometry as well.
# 
# Output the parts of the model in different
# variable outputs in the python 3 node in
# grasshopper.
panel = Panel(limits.out)  # disabled
entwine = Entwine(Branch00=geometry, Branch01=number, FlattenInputs=True)  # disabled
limits_2 = Script(x_factor=number_slider_5, x_start=number_slider, x_end=number_slider_2, num_points=number_slider_4, n=number_slider_3)  # -> out, a, b; inputs x_factor: Double, x_start: Double, x_end: Double, num_points: Int32, n: Int32; disabled
# ---------- limits_2: Python ----------
import Rhino
import Rhino.Geometry as rg
import math
import numpy as np

def calculate_curve(x, n):
    """
    Calculate the y-value of the curve at a given x, based on the parameter n
    """
    s = np.linspace(1, n, n)
    y = np.sum(np.sin((s / n) * x)) / n
    return y

def generate_curve(x_start, x_end, num_points, n):
    """
    Generate a curve from x_start to x_end with num_points points, using parameter n
    """
    # Empty list to store the points
    curve_points = []
    
    # Loop through x-values from x_start to x_end
    for x in np.linspace(x_start, x_end, num_points):
        y = calculate_curve(x_factor*x, n)
        z = 0  # Assuming the curve is in the xy-plane
        point = rg.Point3d(x, y, z)
        curve_points.append(point)
    
    # Create a curve from the points
    return rg.Curve.CreateInterpolatedCurve(curve_points, 3)

# Input variables
# = x_start_  # Connect this to a Grasshopper slider
#x_end = x_end_  # Connect this to a Grasshopper slider
#num_points = num_points_  # Connect this to a Grasshopper slider
#n = n_  # Connect this to a Grasshopper slider

# Generate the curve
curve = generate_curve(x_start, x_end, num_points, n)

# Generate a sphere at the start of the curve
start_sphere = rg.Sphere(curve.PointAtStart, 1)

# Create an empty list to store the output geometry
output_geometry = []

# Add geometry to output list
output_geometry.append(curve)
output_geometry.append(start_sphere.ToBrep())

# Output the geometry and curve length
a = output_geometry
b = curve.GetLength() if curve else 0
# ---------- end limits_2 ----------
limits_3 = Script(
    t_start=number_slider_6,
    t_end=Slider(10, range=0..10),
    num_points=Slider(100, range=0..100),
    n=Slider(100, range=0..100))  # -> out, a, b; inputs t_start: Double, t_end: Double, num_points: Int32, n: Int32
# ---------- limits_3: Python ----------
import Rhino
import Rhino.Geometry as rg
import numpy as np

def calculate_curve(t, n):
    """
    Calculate the x, y, z coordinates at a given t, based on the parameter n
    """
    s = np.linspace(1, n, n)
    x = np.sum(np.cos((s / n) * t)) / n
    y = np.sum(np.sin((s / n) * t)) / n
    z = np.sum(np.sin((s / n) * (t + np.pi / 4))) / n
    return x, y, z

def generate_curve(t_start, t_end, num_points, n):
    """
    Generate a curve from t_start to t_end with num_points, using parameter n
    """
    curve_points = []
    
    for t in np.linspace(t_start, t_end, num_points):
        x, y, z = calculate_curve(t, n)
        point = rg.Point3d(x, y, z)
        curve_points.append(point)
    
    return rg.Curve.CreateInterpolatedCurve(curve_points, 3)

# Input variables
t_start = t_start_  # Connect this to a Grasshopper slider, say from 0 to 10
t_end = t_end_  # Connect this to a Grasshopper slider, say from 0 to 10
num_points = num_points_  # Connect this to a Grasshopper slider, say from 100 to 1000
n = n_  # Connect this to a Grasshopper slider, say from 10 to 100

# Generate the curve
curve = generate_curve(t_start, t_end, num_points, n)

# Generate a sphere at the start and end of the curve
start_sphere = rg.Sphere(curve.PointAtStart, 0.2)
end_sphere = rg.Sphere(curve.PointAtEnd, 0.2)

# Create an empty list to store the output geometry
output_geometry = []

# Add geometry to output list
output_geometry.append(curve)
output_geometry.append(start_sphere.ToBrep())
output_geometry.append(end_sphere.ToBrep())

# Output the geometry and curve length
a = output_geometry
b = curve.GetLength() if curve else 0
# ---------- end limits_3 ----------
range = Range(Domain=Domain(0, 1), Steps="9")
geometry_2 = Geometry(limits_2.a)  # disabled
number_2 = Number(limits_2.b)  # disabled
geometry_3 = Geometry(limits_3.a)
number_3 = Number(limits_3.b)
# gpt-4 Initial Response
# To create a 3D geometric model using calculus and limits in
# Python for use in a Python 3 node in Grasshopper for Rhino 8 WIP,
# you would need to use the Rhino Common API to interact with the
# Rhino environment. For calculus and limits, we can use Python's native
# capabilities or libraries like NumPy or SymPy.
# Below is a simplified example that demonstrates this idea.
# 
# Let's assume we want to create a 3D model of a curve
# y=lim n→∞ 1/n ∑ (k=1 to n) sin(k/n*x)
# sampled along the x-axis from -10 to 10.
# This curve can be thought of as the limiting case of a finite Fourier series.
panel_2 = Panel(entwine)  # disabled
panel_3 = Panel(limits_2.out)  # disabled
panel_4 = Panel(limits_3.out)
graph_mapper = GraphMapper(
    range,
    x0=0,
    x1=1,
    y0=0,
    y1=1,
    container_name="Sine Summation",
    Equation0_px=[0.07545471191, 0.3329273462],
    Equation0_py=[0, 0.009647846222],
    Equation1_px=[0.6061634421, 0.9424543977],
    Equation1_py=[0.1110518575, 0.01978826523])
entwine_2 = Entwine(Branch00=geometry_2, Branch01=number_2, FlattenInputs=True)  # disabled
entwine_3 = Entwine(Branch00=geometry_3, Branch01=number_3, FlattenInputs=True)
list_item = ListItem(List=geometry_3, Index=0, Wrap=True)
panel_5 = Panel(entwine_2)  # disabled
panel_6 = Panel(entwine_3)
pipe_variable = PipeVariable(Curve=reparameterize(list_item), Parameters=range, Radii=graph_mapper, Caps=0)
# gpt-4 Initial Response
# Certainly! Let's create a 3D parametric curve
# based on a more complex trigonometric
# polynomial. This curve will be in the form
image_sampler = ImageSampler(
    FilePath="C:\Users\Sculpture\Desktop\Data_Scientist\001_Mathematics\Calculus\003b_limits.JPG",
    Filter="Colour",
    Interpolate=False,
    Umax=1,
    Umin=0,
    Vmax=1,
    Vmin=0,
    Wrap=1)
