# Grasshopper definition B_004_derivatives.gh (Grasshopper 1.0.7)
# plug-ins: RhinoCodePluginGH

# ----
# Oscillation Algorithm
# The oscillation algorithm can be use to animate
# any geometry that is driven by a number sliders.
# Simply swap out the number sliders at the
# multiplication node in the oscillation script.
panel = Panel("1")
trigger = Trigger(Interval=20, TimerInterval=20, Target=data_recorder)
data_recorder = DataRecorder(panel, DataLimit=-10, RecordData=False)
list_length = ListLength(List=data_recorder)
division = Division(A=list_length, B=Slider(519, range=0..1000))
cosine = Cosine(Value=division)
sine = Sine(Value=division)
panel_2 = Panel([sine, cosine])

multiplication = Multiplication(A=sine, B=Slider(6.791, range=0..10))
multiplication_2 = Multiplication(A=cosine, B=Slider(7.28, range=0..10))
# ADVANCED
multiplication_3 = Multiplication(A=sine, B=Slider(0.531, range=0..10))
multiplication_4 = Multiplication(A=cosine, B=Slider(-3, range=-3..3))
multiplication_5 = Multiplication(A=sine, B=Slider(2.24, range=-3..3))
multiplication_6 = Multiplication(A=cosine, B=Slider(3, range=-3..3))
number_slider = Slider(-1.86, range=-3..3)  # disabled
number_slider_2 = Slider(100, range=0..100)  # disabled
# PARAMETRIC
number_slider_3 = Slider(3, range=-3..3)  # disabled
# gpt-4 Text Prompt
# Great, now make the script much more complex model
# with complex trigonometric polynomials and the
# NUMPY python library. Be sure to incorporate
# the previous code logic.
# ensure that this script produces 3d geometry as
# well for Data visualization purposes.
number_slider_4 = Slider(10.68, range=0..100)  # disabled
# BASIC
derivatives = Script()  # -> out, a, b; disabled
# ---------- derivatives: Python ----------
import Rhino
import Rhino.Geometry as rg
import math

def main():
    points = []
    tangents = []
    scale_factor = 0.1  # To scale down tangent vectors for visualization

    for t in range(0, 360, 10):  # t varies from 0 to 360 degrees
        t_rad = math.radians(t)  # Convert to radians

        # Parametric equations for x, y, z
        x = math.sin(t_rad)
        y = math.cos(t_rad)
        z = t_rad

        # Calculate the point at parameter t
        pt = rg.Point3d(x, y, z)
        points.append(pt)

        # Derivatives (tangents) at parameter t
        dx = math.cos(t_rad)
        dy = -math.sin(t_rad)
        dz = 1.0

        # Calculate the tangent vector at point pt
        tangent = rg.Vector3d(dx, dy, dz)
        tangent.Unitize()  # Optional: make it a unit vector
        tangent *= scale_factor  # Scale down for visualization

        tangents.append(rg.Line(pt, pt + tangent))

    return points, tangents

# Outputs for Grasshopper Python 3 Node
points_output, tangents_output = main()

# Assign your output variables in Grasshopper
a = points_output
b = tangents_output
# ---------- end derivatives ----------
geometry = Geometry(derivatives.a)  # disabled
number = Number(derivatives.b)  # disabled
# Becoming a Data Scientist
# with Python in Grasshopper
# at Wickerson Studios
# 001 Mathematics
# 002 CALCULUS
# 004 derivatives
# gpt-4 Text Prompt
# Create a geometric 3D model with
# 
# Mathematics
# 
# CALCULUS
# 
# derivatives
# 
# 
# in python 3 code for the python 3 script
# node in grasshopper for Rhino8WIP using the
# 
# Rhino Common API to create some geometry as well.
# 
# Output the parts of the model in different
# variable outputs in the python 3 node in
# grasshopper.
panel_3 = Panel(derivatives.out)  # disabled
derivatives_2 = Script(
    frequencies=[multiplication, multiplication_2, multiplication_3],
    amplitudes=[multiplication_4, multiplication_5, multiplication_6],
    num_points=Slider(100, range=0..100),
    factor=Slider(2.66, range=0..10),
    omega_factor=Slider(0.23, range=0..10))  # -> out, a, b; inputs frequencies: list of Double, amplitudes: list of Double, num_points: Int32, factor: Double, omega_factor: Double
# ---------- derivatives_2: Python ----------
import Rhino
import Rhino.Geometry as rg
import numpy as np
import math

def complex_curve(frequencies, amplitudes, num_points):
    points = []
    tangents = []
    scale_factor = factor  # To scale down tangent vectors for visualization

    # Generate a time array
    time = np.linspace(0, 2 * np.pi, num_points)

    for t in time:
        # Initialize complex numbers for position and tangent
        z_pos = complex(0, 0)
        z_tangent = complex(0, 0)

        for freq, amp in zip(frequencies, amplitudes):
            omega = omega_factor * np.pi * freq

            # Update complex position based on Fourier series
            z_pos += amp * np.exp(1j * omega * t)

            # Update complex tangent (derivative of position)
            z_tangent += 1j * omega * amp * np.exp(1j * omega * t)

        # Extract x, y, z from the complex position
        x, y = z_pos.real, z_pos.imag
        z = t  # you can also make this parametric based on z_pos or other variables
        pt = rg.Point3d(x, y, z)
        points.append(pt)

        # Extract dx, dy, dz from the complex tangent
        dx, dy = z_tangent.real, z_tangent.imag
        dz = 1.0  # or you could derive this from a parametric function of z
        tangent = rg.Vector3d(dx, dy, dz)
        tangent.Unitize()
        tangent *= scale_factor
        tangents.append(rg.Line(pt, pt + tangent))

    return points, tangents

# Inputs for Grasshopper Python 3 Node
#frequencies = [1, 2, 3]  # You can connect this to a Grasshopper list
#amplitudes = [1, 0.5, 0.3]  # You can connect this to a Grasshopper list
#num_points = 100  # You can connect this to a Grasshopper slider

# Outputs for Grasshopper Python 3 Node
points_output, tangents_output = complex_curve(frequencies, amplitudes, num_points)

# Assign your output variables in Grasshopper
a = points_output
b = tangents_output
# ---------- end derivatives_2 ----------
entwine = Entwine(Branch00=geometry, Branch01=number, FlattenInputs=True)  # disabled
derivatives_3 = Script(frequency=number_slider_3, amplitude=number_slider, num_points=number_slider_2, factor=number_slider_4)  # -> out, a, b; inputs frequency: Double, amplitude: Double, num_points: Int32, factor: Double; disabled
# ---------- derivatives_3: Python ----------
import Rhino
import Rhino.Geometry as rg
import math

def create_curve(frequency, amplitude, num_points):
    points = []
    tangents = []
    scale_factor = factor  # To scale down tangent vectors for visualization

    for i in range(num_points):  
        t = i * (2.0 * math.pi / (num_points - 1))  # t varies from 0 to 2*pi

        # Parametric equations for x, y, z
        x = amplitude * math.sin(frequency * t)
        y = amplitude * math.cos(frequency * t)
        z = t

        # Calculate the point at parameter t
        pt = rg.Point3d(x, y, z)
        points.append(pt)

        # Derivatives (tangents) at parameter t
        dx = amplitude * frequency * math.cos(frequency * t)
        dy = -amplitude * frequency * math.sin(frequency * t)
        dz = 1.0

        # Calculate the tangent vector at point pt
        tangent = rg.Vector3d(dx, dy, dz)
        tangent.Unitize()  # Optional: make it a unit vector
        tangent *= scale_factor  # Scale down for visualization

        tangents.append(rg.Line(pt, pt + tangent))

    return points, tangents

# Inputs for Grasshopper Python 3 Node
#frequency = 1.0  # You can connect this to a Grasshopper slider
#amplitude = 1.0  # You can connect this to a Grasshopper slider
#num_points = 36  # You can connect this to a Grasshopper slider

# Outputs for Grasshopper Python 3 Node
points_output, tangents_output = create_curve(frequency, amplitude, num_points)

# Assign your output variables in Grasshopper
a = points_output
b = tangents_output
# ---------- end derivatives_3 ----------
geometry_2 = Geometry(derivatives_3.a)  # disabled
geometry_3 = Geometry(derivatives_3.b)  # disabled
geometry_4 = Geometry(derivatives_2.a)
geometry_5 = Geometry(derivatives_2.b)
interpolate = Interpolate(Vertices=geometry_4, Degree=3, Periodic=False, KnotStyle=1)  # -> Curve, Length, Domain
# gpt-4 Initial Response
# To achieve this task, you'll need to have Rhino8WIP and
# Grasshopper installed, along with the Python scripting component
# within Grasshopper. I'll outline a Python script that uses calculus
# (derivatives) to generate a simple 3D curve, which could represent
# a geometrical 3D model. You can place this script within a
# Python 3 component in Grasshopper.
# 
# We'll be creating a parametric curve
# r = (t) with the components:
# x=sin(t)
# y=cos(t)
# z=t
# We'll also calculate and display its tangent
# vector at several points, which involves taking the derivative
# r′ =  (t).
panel_4 = Panel(entwine)  # disabled
panel_5 = Panel(derivatives_2.out)
entwine_2 = Entwine(Branch00=geometry_4, Branch01=geometry_5, FlattenInputs=True)
panel_6 = Panel(derivatives_3.out)  # disabled
entwine_3 = Entwine(Branch00=geometry_2, Branch01=geometry_3, FlattenInputs=True)  # disabled
panel_7 = Panel(entwine_2)
# gpt-4 Initial Response
# Certainly! Let's extend the model to produce
# more complex 3D geometry using complex
# trigonometric polynomials and the NumPy library.
#  Specifically, we'll employ complex trigonometric
# series for the parametric functions that define
# the curve. The new model will use complex
# numbers to create a spiral shape based on a
# Fourier series with multiple frequency
# components.
# 
# The complex trigonometric polynomial will take
# the form:
panel_8 = Panel(entwine_3)  # disabled
image_sampler = ImageSampler(
    FilePath="C:\Users\Sculpture\Desktop\Data_Scientist\001_Mathematics\Calculus\004b_derivatives.JPG",
    Filter="Colour",
    Interpolate=False,
    Umax=1,
    Umin=0,
    Vmax=1,
    Vmin=0,
    Wrap=1)
