# Grasshopper definition C_001_propability_theory.gh (Grasshopper 1.0.7)
# plug-ins: RhinoCodePluginGH

# ----
# Oscillation Algorithm
# The oscillation algorithm can be use to animate
# any geometry that is driven by a number sliders.
# Simply swap out the number sliders at the
# multiplication node in the oscillation script.
panel = Panel("1")  # disabled
trigger = Trigger(Interval=20, TimerInterval=20, Target=data_recorder)  # disabled
data_recorder = DataRecorder(panel, DataLimit=-10, RecordData=False)  # disabled
number_slider = Slider(84, range=0..1000)  # disabled
list_length = ListLength(List=data_recorder)  # disabled
division = Division(A=list_length, B=number_slider)  # disabled
cosine = Cosine(Value=division)  # disabled
sine = Sine(Value=division)  # disabled
panel_2 = Panel([sine, cosine])  # disabled

number_slider_2 = Slider(0.531, range=0..10)  # disabled
number_slider_3 = Slider(-3, range=-3..3)  # disabled
number_slider_4 = Slider(6.791, range=0..10)  # disabled
number_slider_5 = Slider(7.28, range=0..10)  # disabled
multiplication = Multiplication(A=sine, B=number_slider_4)  # disabled
multiplication_2 = Multiplication(A=cosine, B=number_slider_5)  # disabled
multiplication_3 = Multiplication(A=sine, B=number_slider_2)  # disabled
multiplication_4 = Multiplication(A=cosine, B=number_slider_3)  # disabled

# ----
# PARAMETRIC
number_slider_6 = Slider(0, range=0..1)  # disabled
number_slider_7 = Slider(0, range=0..1)  # disabled
number_slider_8 = Slider(10, range=0..10)  # disabled
# gpt-4 Text Prompt
number_slider_9 = Slider(15, range=0..100)  # disabled
number_slider_10 = Slider(10, range=0..10)  # disabled

# ----
# Great, now make the script much more complex model
# with complex trigonometric polynomials and the
# NUMPY python library. Be sure to incorporate
# the previous code logic.
# ensure that this script produces 3d geometry as
# well for Data visualization purposes.
# ADVANCED
number_slider_11 = Slider(0, range=0..1)

# ----
# BASIC
probability_theory = Script()  # -> out, a, b; disabled
# ---------- probability_theory: Python ----------
import Rhino.Geometry as rg
import random
import math

def create_point(x, y, z):
    return rg.Point3d(x, y, z)

def create_line(point1, point2):
    return rg.Line(point1, point2)

# Initialize outputs
output_points = []
output_lines = []

# Probability and statistics: Using Gaussian Distribution for random points
mean_x = 0.0
mean_y = 0.0
std_dev_x = 10.0
std_dev_y = 10.0
num_points = 20

# Create random points using Gaussian distribution
for i in range(num_points):
    x = random.gauss(mean_x, std_dev_x)
    y = random.gauss(mean_y, std_dev_y)
    z = 0.0
    point = create_point(x, y, z)
    output_points.append(point)

# Create lines between the points (forming a simple geometric structure)
for i in range(len(output_points) - 1):
    line = create_line(output_points[i], output_points[i + 1])
    output_lines.append(line)

# Output the points and lines
a = output_points
b = output_lines
# ---------- end probability_theory ----------
# SORTED POINTS
probability_theory_2 = Script()  # -> out, a, b, c; disabled
# ---------- probability_theory_2: Python ----------
import Rhino.Geometry as rg
import random
import math

def create_point(x, y, z):
    return rg.Point3d(x, y, z)

def create_line(point1, point2):
    return rg.Line(point1, point2)

def distance_to_origin(point):
    origin = rg.Point3d(0,0,0)
    return origin.DistanceTo(point)

# Initialize outputs
output_points = []
output_lines = []
sorted_lines = []

# Probability and statistics: Using Gaussian Distribution for random points
mean_x = 0.0
mean_y = 0.0
std_dev_x = 10.0
std_dev_y = 10.0
num_points = 20

# Create random points using Gaussian distribution
for i in range(num_points):
    x = random.gauss(mean_x, std_dev_x)
    y = random.gauss(mean_y, std_dev_y)
    z = 0.0
    point = create_point(x, y, z)
    output_points.append(point)

# Sort points by their distance to the origin
output_points.sort(key=distance_to_origin)

# Create lines between the sorted points
for i in range(len(output_points) - 1):
    line = create_line(output_points[i], output_points[i + 1])
    output_lines.append(line)

# Organize the sorted points into a grid for better visualization
grid_points = []
row_length = int(math.sqrt(num_points))
for i in range(row_length):
    for j in range(row_length):
        if i*row_length + j < len(output_points):
            point = output_points[i*row_length + j]
            grid_point = create_point(i*20, j*20, 0)
            grid_points.append(grid_point)

# Create lines between the sorted grid points for better visualization
for i in range(len(grid_points) - 1):
    line = create_line(grid_points[i], grid_points[i + 1])
    sorted_lines.append(line)

# Output the grid points and lines
a = grid_points
b = output_lines
c = sorted_lines
# ---------- end probability_theory_2 ----------
geometry = Geometry(probability_theory.a)  # disabled
geometry_2 = Geometry(probability_theory.b)  # disabled
geometry_3 = Geometry(probability_theory_2.a)  # disabled
geometry_4 = Geometry(probability_theory_2.b)  # disabled
geometry_5 = Geometry(probability_theory_2.c)  # disabled
# Becoming a Data Scientist
# with Python in Grasshopper
# at Wickerson Studios
# 001 Mathematics
# 003 PROBABILITY AND STATISTICS
# 001 propability theory
# gpt-4 Text Prompt
# Create a geometric 3D model with
# 
# Mathematics
# 
# PROBABILITY AND STATISTICS
# 
# propability theory
# 
# 
# in python 3 code for the python 3 script
# node in grasshopper for Rhino8WIP using the
# 
# Rhino Common API to create some geometry as well.
# 
# Output the parts of the model in different
# variable outputs in the python 3 node in
# grasshopper.
panel_3 = Panel(probability_theory.out)  # disabled
entwine = Entwine(Branch00=geometry, Branch01=geometry_2, FlattenInputs=True)  # disabled
probability_theory_3 = Script(
    mean_x=number_slider_6,
    mean_y=number_slider_7,
    std_dev_x=number_slider_10,
    std_dev_y=number_slider_8,
    num_points=number_slider_9)  # -> out, a, b, c; inputs mean_x: Double, mean_y: Double, std_dev_x: Double, std_dev_y: Double, num_points: Int32; disabled
# ---------- probability_theory_3: Python ----------
import Rhino.Geometry as rg
import random
import math

def create_point(x, y, z):
    return rg.Point3d(x, y, z)

def create_line(point1, point2):
    return rg.Line(point1, point2)

def distance_to_origin(point):
    origin = rg.Point3d(0,0,0)
    return origin.DistanceTo(point)

# Initialize outputs
output_points = []
output_lines = []
sorted_lines = []

# Probability and statistics: Using Gaussian Distribution for random points
#mean_x = 0.0
#mean_y = 0.0
#std_dev_x = 10.0
#std_dev_y = 10.0
#num_points = 20

# Create random points using Gaussian distribution
for i in range(num_points):
    x = random.gauss(mean_x, std_dev_x)
    y = random.gauss(mean_y, std_dev_y)
    z = 0.0
    point = create_point(x, y, z)
    output_points.append(point)

# Sort points by their distance to the origin
output_points.sort(key=distance_to_origin)

# Create lines between the sorted points
for i in range(len(output_points) - 1):
    line = create_line(output_points[i], output_points[i + 1])
    output_lines.append(line)

# Organize the sorted points into a grid for better visualization
grid_points = []
row_length = int(math.sqrt(num_points))
for i in range(row_length):
    for j in range(row_length):
        if i*row_length + j < len(output_points):
            point = output_points[i*row_length + j]
            grid_point = create_point(i*20, j*20, 0)
            grid_points.append(grid_point)

# Create lines between the sorted grid points for better visualization
for i in range(len(grid_points) - 1):
    line = create_line(grid_points[i], grid_points[i + 1])
    sorted_lines.append(line)

# Output the grid points and lines
a = grid_points
b = output_lines
c = sorted_lines
# ---------- end probability_theory_3 ----------
entwine_2 = Entwine(Branch00=geometry_3, Branch01=geometry_4, Branch02=geometry_5, FlattenInputs=True)  # disabled
panel_4 = Panel(probability_theory_2.out)  # disabled
multiplication_5 = Multiplication(A=sine, B=Slider(-0.94, range=-3..3))
multiplication_6 = Multiplication(A=cosine, B=Slider(-0.26, range=-3..3))
geometry_6 = Geometry(probability_theory_3.a)  # disabled
geometry_7 = Geometry(probability_theory_3.b)  # disabled
geometry_8 = Geometry(probability_theory_3.c)  # disabled
# gpt-4 Initial Response
# Creating a full Python 3 script that combines
# mathematics, probability theory, and uses the
# Rhino Common API for Grasshopper in Rhino 8
# WIP is a substantial task. Below is a simplified
# example to demonstrate the concept. This script will:
# 
# Create random points using a Gaussian
# distribution (probability and statistics).
# Connect the points to form lines (geometry).
# Output the lines as well as the points.
panel_5 = Panel(entwine)  # disabled
panel_6 = Panel(entwine_2)  # disabled
# gpt-4 Initial Response
entwine_3 = Entwine(Branch00=geometry_6, Branch01=geometry_7, Branch02=geometry_8, FlattenInputs=True)  # disabled
panel_7 = Panel(probability_theory_3.out)  # disabled
probability_theory_4 = Script(
    mean_x=number_slider_11,
    mean_y=Slider(0, range=0..1),
    std_dev_x=Slider(10, range=0..10),
    std_dev_y=Slider(10, range=0..10),
    num_points=Slider(29, range=0..100),
    theta_max=Slider(30.53, range=0..100),
    num_theta_pts=Slider(1000, range=0..1000),
    theta_max_2=Slider(27.77, range=0..100),
    poly_degree=Slider(2, range=0..3),
    cos_coeff=multiplication_5,
    sin_coeff=multiplication_6)  # -> out, a, b, c; inputs mean_x: Double, mean_y: Double, std_dev_x: Double, std_dev_y: Double, num_points: Int32, theta_max: Double, num_theta_pts: Int32, theta_max_2: Double, poly_degree: Int32, cos_coeff: Double, sin_coeff: Double
# ---------- probability_theory_4: Python ----------
import Rhino.Geometry as rg
import numpy as np
import random
import math

# Function to create a point
def create_point(x, y, z):
    return rg.Point3d(x, y, z)

# Function to create a line
def create_line(point1, point2):
    return rg.Line(point1, point2)

# Function to sort by distance to origin
def distance_to_origin(point):
    origin = rg.Point3d(0, 0, 0)
    return origin.DistanceTo(point)

# Initialize outputs
output_points = []
output_lines = []
complex_geometry = []

# User-defined Parameters for Gaussian points
"""
mean_x = x_mean  # Replace with a user-defined parameter
mean_y = y_mean  # Replace with a user-defined parameter
std_dev_x = x_std_dev  # Replace with a user-defined parameter
std_dev_y = y_std_dev  # Replace with a user-defined parameter
num_points = num_pts  # Replace with a user-defined parameter
"""
# User-defined Parameters for Complex Geometry
num_theta_points = num_theta_pts  # Replace with a user-defined parameter
theta_max = theta_max  # Replace with a user-defined parameter
polynomial_degree = poly_degree  # Replace with a user-defined parameter
cos_coefficient = cos_coeff  # Replace with a user-defined parameter
sin_coefficient = sin_coeff  # Replace with a user-defined parameter

# Create random points using Gaussian distribution
for i in range(num_points):
    x = random.gauss(mean_x, std_dev_x)
    y = random.gauss(mean_y, std_dev_y)
    z = 0.0
    point = create_point(x, y, z)
    output_points.append(point)

# Sort points by their distance to the origin
output_points.sort(key=distance_to_origin)

# Create lines between the sorted points
for i in range(len(output_points) - 1):
    line = create_line(output_points[i], output_points[i + 1])
    output_lines.append(line)

# Complex trigonometric polynomial geometry (3D spiral)
theta = np.linspace(0, theta_max, num_theta_points)
r = theta ** polynomial_degree  # Polynomial spiral, degree controlled by user
x = r * np.cos(theta * cos_coefficient)
y = r * np.sin(theta * sin_coefficient)
z = r * np.cos(theta * cos_coefficient) * np.sin(theta * sin_coefficient)  # 3D modulation

for i in range(len(theta) - 1):
    point1 = create_point(x[i], y[i], z[i])
    point2 = create_point(x[i + 1], y[i + 1], z[i + 1])
    line = create_line(point1, point2)
    complex_geometry.append(line)

# Output
a = output_points
b = output_lines
c = complex_geometry
# ---------- end probability_theory_4 ----------
geometry_9 = Geometry(probability_theory_4.a)
geometry_10 = Geometry(probability_theory_4.b)
geometry_11 = Geometry(probability_theory_4.c)
panel_8 = Panel(entwine_3)  # disabled
# Certainly! To create a more complex geometric
# model that utilizes trigonometric polynomials
# and NumPy for data manipulation, you can
# modify and extend the previous code. Here's how:
panel_9 = Panel(probability_theory_4.out)
entwine_4 = Entwine(Branch00=geometry_9, Branch01=geometry_10, Branch02=geometry_11, FlattenInputs=True)
panel_10 = Panel(entwine_4)
