# Grasshopper definition C_002_random_variables.gh (Grasshopper 1.0.7)
# plug-ins: RhinoCodePluginGH

# ----
# Oscillation Algorithm
# The oscillation algorithm can be use to animate
# any geometry that is driven by a number sliders.
# Simply swap out the number sliders at the
# multiplication node in the oscillation script.
panel = Panel("1")  # disabled
trigger = Trigger(Interval=20, TimerInterval=20, Target=data_recorder)  # disabled
data_recorder = DataRecorder(panel, DataLimit=-10, RecordData=False)  # disabled
number_slider = Slider(84, range=0..1000)  # disabled
list_length = ListLength(List=data_recorder)  # disabled
division = Division(A=list_length, B=number_slider)  # disabled
cosine = Cosine(Value=division)  # disabled
sine = Sine(Value=division)  # disabled
panel_2 = Panel([sine, cosine])  # disabled

number_slider_2 = Slider(0.531, range=0..10)  # disabled
number_slider_3 = Slider(-3, range=-3..3)  # disabled
number_slider_4 = Slider(6.791, range=0..10)  # disabled
number_slider_5 = Slider(7.28, range=0..10)  # disabled
multiplication = Multiplication(A=sine, B=number_slider_4)  # disabled
multiplication_2 = Multiplication(A=cosine, B=number_slider_5)  # disabled
multiplication_3 = Multiplication(A=sine, B=number_slider_2)  # disabled
multiplication_4 = Multiplication(A=cosine, B=number_slider_3)  # disabled

# ----
# BASIC
random_variables = Script()  # -> out, a, b, c; disabled
# ---------- random_variables: Python ----------
import Rhino.Geometry as rg
import random

# Function to generate random points
def generate_random_points(num_points=10):
    points = []
    for i in range(num_points):
        x = random.uniform(0, 10)
        y = random.uniform(0, 10)
        z = random.uniform(0, 10)
        points.append(rg.Point3d(x, y, z))
    return points

# Function to generate lines from a list of points
def generate_lines_from_points(points):
    lines = []
    for i in range(len(points)):
        for j in range(i+1, len(points)):
            lines.append(rg.Line(points[i], points[j]))
    return lines

# Generate random points
points = generate_random_points(num_points=5)

# Generate lines
lines = generate_lines_from_points(points)

# Create a mesh
mesh = rg.Mesh()
for pt in points:
    mesh.Vertices.Add(pt)

# Assuming you have a simple convex set of points, a basic mesh face connecting them
# This may not be suitable for more complex point sets
if len(points) >= 4:
    for i in range(1, len(points) - 1):
        mesh.Faces.AddFace(0, i, i+1)

# Output the parts of the model
a = points
b = lines
c = mesh
# ---------- end random_variables ----------
number_slider_6 = Slider(3, range=0..10)
# ADVANCED
number_slider_7 = Slider(3, range=0..10)  # disabled
# SORTED
number_slider_8 = Slider(2, range=0..10)  # disabled
# gpt-4 Text Prompt
# Great, now make the script much more complex model
# with complex trigonometric polynomials and the
# NUMPY python library. Be sure to incorporate
# the previous code logic.
# ensure that this script produces 3d geometry as
# well for Data visualization purposes.
number_slider_9 = Slider(10, range=0..100)  # disabled
geometry = Geometry(random_variables.a)  # disabled
geometry_2 = Geometry(random_variables.b)  # disabled
# PARAMETRIC
geometry_3 = Geometry(random_variables.c)  # disabled
# Becoming a Data Scientist
# with Python in Grasshopper
# at Wickerson Studios
# 001 Mathematics
# 003 PROBABILITY AND STATISTICS
# 002 random variables
# gpt-4 Text Prompt
# Create a geometric 3D model with
# 
# Mathematics
# 
# PROBABILITY AND STATISTICS
# 
# random variables
# 
# 
# in python 3 code for the python 3 script
# node in grasshopper for Rhino8WIP using the
# 
# Rhino Common API to create some geometry as well.
# 
# Output the parts of the model in different
# variable outputs in the python 3 node in
# grasshopper.
panel_3 = Panel(random_variables.out)  # disabled
entwine = Entwine(Branch00=geometry, Branch01=geometry_2, Branch02=geometry_3, FlattenInputs=True)  # disabled
random_variables_2 = Script(x=number_slider_9)  # -> out, a, b, c; inputs x: Int32; disabled
# ---------- random_variables_2: Python ----------
import Rhino.Geometry as rg
import random

# Function to generate random points
def generate_random_points(num_points=10, x_min=0, x_max=10, y_min=0, y_max=10, z_min=0, z_max=10):
    points = []
    for i in range(num_points):
        x = random.uniform(x_min, x_max)
        y = random.uniform(y_min, y_max)
        z = random.uniform(z_min, z_max)
        points.append(rg.Point3d(x, y, z))
    return points

# Function to generate lines from a list of points
def generate_lines_from_points(points):
    lines = []
    for i in range(len(points)):
        for j in range(i+1, len(points)):
            lines.append(rg.Line(points[i], points[j]))
    return lines

# Parameter: Number of Points
num_points = x  # Connect this variable to an input in Grasshopper to control the number of points

# Parameters: Bounds for the random coordinates
x_min, x_max = 0, 10
y_min, y_max = 0, 10
z_min, z_max = 0, 10

# Generate random points
points = generate_random_points(num_points, x_min, x_max, y_min, y_max, z_min, z_max)

# Generate lines
lines = generate_lines_from_points(points)

# Create a mesh
mesh = rg.Mesh()
for pt in points:
    mesh.Vertices.Add(pt)

# Assuming you have a simple convex set of points, a basic mesh face connecting them
# This may not be suitable for more complex point sets
if len(points) >= 4:
    for i in range(1, len(points) - 1):
        mesh.Faces.AddFace(0, i, i+1)

# Output the parts of the model
a = points  # Connect this to an output in Grasshopper
b = lines  # Connect this to another output in Grasshopper
c = mesh  # Connect this to yet another output in Grasshopper
# ---------- end random_variables_2 ----------
random_variables_3 = Script(rows=number_slider_6, cols=number_slider_6)  # -> out, a, b, c; inputs rows: Int32, cols: Int32
# ---------- random_variables_3: Python ----------
import Rhino.Geometry as rg
import random
import numpy as np

# Function to generate complex trigonometric points in a grid
def generate_trig_points(rows, cols, x_min=0, x_max=10, y_min=0, y_max=10, z_min=0, z_max=10):
    points = []
    for i in range(rows):
        for j in range(cols):
            x = random.uniform(x_min, x_max)
            y = random.uniform(y_min, y_max)
            z = random.uniform(z_min, z_max)
            
            # Apply trigonometric polynomial transformations
            x = x + np.sin(y) + np.sin(z)
            y = y + np.sin(x) + np.sin(z)
            z = z + np.sin(x) + np.sin(y)
            
            points.append(rg.Point3d(x, y, z))
    return points

# Function to sort points based on their x and y coordinates
def sort_points(points):
    return sorted(points, key=lambda pt: (pt.Y, pt.X))

# Parameter: Number of Points (Rows x Columns for grid)
#rows, cols = 3, 3  # You can connect these to inputs in Grasshopper to control the grid size

# Parameters: Bounds for the random coordinates
x_min, x_max = 0, 10
y_min, y_max = 0, 10
z_min, z_max = 0, 10

# Generate trigonometric points in a grid
points = generate_trig_points(rows, cols, x_min, x_max, y_min, y_max, z_min, z_max)

# Sort the points
sorted_points = sort_points(points)

# Create a NURBS surface from the sorted points
degree_u = 2
degree_v = 2
nurbs_surface = rg.NurbsSurface.CreateThroughPoints(sorted_points, rows, cols, degree_u, degree_v, False, False)

# Generate lines for visualization
lines = []
for i in range(rows):
    for j in range(cols - 1):
        lines.append(rg.Line(sorted_points[i * cols + j], sorted_points[i * cols + j + 1]))
for i in range(rows - 1):
    for j in range(cols):
        lines.append(rg.Line(sorted_points[i * cols + j], sorted_points[(i + 1) * cols + j]))

# Output the parts of the model
a = sorted_points  # Connect this to an output in Grasshopper
b = lines  # Connect this to another output in Grasshopper
c = nurbs_surface  # Connect this to yet another output in Grasshopper
# ---------- end random_variables_3 ----------
random_variables_4 = Script(rows=number_slider_7, cols=number_slider_8)  # -> out, a, b, c; inputs rows: Int32, cols: Int32; disabled
# ---------- random_variables_4: Python ----------
import Rhino.Geometry as rg
import random
import numpy as np

# Function to generate complex trigonometric points in a grid
def generate_trig_points(rows, cols, x_min=0, x_max=10, y_min=0, y_max=10, z_min=0, z_max=10):
    points = []
    for i in range(rows):
        for j in range(cols):
            x = random.uniform(x_min, x_max)
            y = random.uniform(y_min, y_max)
            z = random.uniform(z_min, z_max)
            
            # Apply trigonometric polynomial transformations
            x = x + np.sin(y) + np.sin(z)
            y = y + np.sin(x) + np.sin(z)
            z = z + np.sin(x) + np.sin(y)
            
            points.append(rg.Point3d(x, y, z))
    return points

# Parameter: Number of Points (Rows x Columns for grid)
#rows, cols = 3, 3  # You can connect these to inputs in Grasshopper to control the grid size

# Parameters: Bounds for the random coordinates
x_min, x_max = 0, 10
y_min, y_max = 0, 10
z_min, z_max = 0, 10

# Generate trigonometric points in a grid
points = generate_trig_points(rows, cols, x_min, x_max, y_min, y_max, z_min, z_max)

# Create a NURBS surface from the grid points
degree_u = 2
degree_v = 2
nurbs_surface = rg.NurbsSurface.CreateThroughPoints(points, rows, cols, degree_u, degree_v, False, False)

# Generate lines for visualization
lines = []
for i in range(rows):
    for j in range(cols - 1):
        lines.append(rg.Line(points[i * cols + j], points[i * cols + j + 1]))
for i in range(rows - 1):
    for j in range(cols):
        lines.append(rg.Line(points[i * cols + j], points[(i + 1) * cols + j]))

# Output the parts of the model
a = points  # Connect this to an output in Grasshopper
b = lines  # Connect this to another output in Grasshopper
c = nurbs_surface  # Connect this to yet another output in Grasshopper
# ---------- end random_variables_4 ----------
# gpt-4 Initial Response
# Creating a 3D geometric model using random
# variables in Python and then using the Rhino
# Common API in Grasshopper for Rhino8WIP
# involves several steps. Below is an example
# Python code to create a simple 3D geometric
# model using probability and statistics, and Rhino
#  Common API.
# 
# Generate random variables to define the
# coordinates of points in a 3D space.
# Create the 3D geometric model using the Rhino
# Common API.
# Output the parts of the model in different
# variable outputs in the Python 3 node in
# Grasshopper.
panel_4 = Panel(entwine)  # disabled
geometry_4 = Geometry(random_variables_2.a)  # disabled
geometry_5 = Geometry(random_variables_2.b)  # disabled
geometry_6 = Geometry(random_variables_2.c)  # disabled
geometry_7 = Geometry(random_variables_3.a)
geometry_8 = Geometry(random_variables_3.b)
geometry_9 = Geometry(random_variables_3.c)
geometry_10 = Geometry(random_variables_4.c)  # disabled
geometry_11 = Geometry(random_variables_4.a)  # disabled
geometry_12 = Geometry(random_variables_4.b)  # disabled
panel_5 = Panel(random_variables_2.out)  # disabled
# Creating a NURBS (Non-Uniform Rational B-
# Splines) surface can be more involved,
# especially when starting with a random set of
# points. NURBS surfaces in Rhino Common can
# be created using the NurbsSurface.Create
# method, but this assumes that you have a well-
# ordered grid of control points.
# 
# In this modified example, I'll create a 3x3 grid of
# points affected by trigonometric polynomials,
# and then construct a NURBS surface using
# these points.
entwine_2 = Entwine(Branch00=geometry_4, Branch01=geometry_5, Branch02=geometry_6, FlattenInputs=True)  # disabled
panel_6 = Panel(random_variables_3.out)
entwine_3 = Entwine(Branch00=geometry_7, Branch01=geometry_8, Branch02=geometry_9, FlattenInputs=True)
panel_7 = Panel(random_variables_4.out)  # disabled
entwine_4 = Entwine(Branch00=geometry_11, Branch01=geometry_12, Branch02=geometry_10, FlattenInputs=True)  # disabled
# gpt-4 Initial Response
panel_8 = Panel(entwine_2)  # disabled
panel_9 = Panel(entwine_3)
panel_10 = Panel(entwine_4)  # disabled
