# Grasshopper definition C_003_distributions.gh (Grasshopper 1.0.7)
# plug-ins: RhinoCodePluginGH

# ----
# Oscillation Algorithm
# The oscillation algorithm can be use to animate
# any geometry that is driven by a number sliders.
# Simply swap out the number sliders at the
# multiplication node in the oscillation script.
panel = Panel("1")  # disabled
trigger = Trigger(Interval=20, TimerInterval=20, Target=data_recorder)  # disabled
data_recorder = DataRecorder(panel, DataLimit=-10, RecordData=False)  # disabled
number_slider = Slider(49, range=0..1000)  # disabled
list_length = ListLength(List=data_recorder)  # disabled
division = Division(A=list_length, B=number_slider)  # disabled
cosine = Cosine(Value=division)  # disabled
sine = Sine(Value=division)  # disabled
panel_2 = Panel([sine, cosine])  # disabled
multiplication = Multiplication(A=sine)  # disabled
multiplication_2 = Multiplication(A=cosine)  # disabled

number_slider_2 = Slider(10, range=-10..10)  # disabled
number_slider_3 = Slider(10, range=-10..10)  # disabled
number_slider_4 = Slider(10, range=-10..10)  # disabled
# gpt-4 Text Prompt
# Great, now make the script much more complex model
# with complex trigonometric polynomials and the
# NUMPY python library. Be sure to incorporate
# the previous code logic.
# ensure that this script produces 3d geometry as
# well for Data visualization purposes.
number_slider_5 = Slider(9.71, range=-10..10)  # disabled
number_slider_6 = Slider(10, range=-10..10)  # disabled
number_slider_7 = Slider(-1.55, range=-10..10)  # disabled
# PARAMETRIC
number_slider_8 = Slider(100, range=0..100)  # disabled
# BASIC
distributions = Script()  # -> out, a; disabled
# ---------- distributions: Python ----------
import Rhino
import random
import numpy as np
import scriptcontext as sc

# Set the random seed for reproducibility
np.random.seed(0)

# Define the number of points
num_points = 100

# Generate random coordinates
x = np.random.normal(0, 10, num_points)
y = np.random.normal(0, 10, num_points)
z = np.random.normal(0, 10, num_points)

# Create a list of points
points = [Rhino.Geometry.Point3d(x[i], y[i], z[i]) for i in range(num_points)]

# Add points to the Rhino document
for point in points:
    sc.doc.Objects.AddPoint(point)

# Define the output
a = points
# ---------- end distributions ----------
# ADVANCED
distributions_2 = Script()  # -> out, a, b, c; disabled
# ---------- distributions_2: Python ----------
import Rhino
import random
import numpy as np
import scriptcontext as sc
import Rhino.Geometry as rg

# Set random seed for reproducibility
np.random.seed(0)

# Number of points and frequency parameter for trigonometric function
num_points = 100
frequency = 2 * np.pi / 20  # Angular frequency
amplitude = 10  # amplitude

# Initialize arrays
x_points = np.zeros(num_points)
y_points = np.zeros(num_points)
z_points = np.zeros(num_points)

# Trigonometric polynomial for x, y, z coordinates
for i in range(num_points):
    theta = i * frequency
    x_points[i] = amplitude * (np.sin(theta) + np.sin(2*theta)/2)
    y_points[i] = amplitude * (np.cos(theta) + np.cos(2*theta)/2)
    z_points[i] = amplitude * (np.sin(theta) * np.cos(theta))

# Create Rhino points
rhino_points = [rg.Point3d(x_points[i], y_points[i], z_points[i]) for i in range(num_points)]

# Add points to Rhino document for visualization (optional)
for point in rhino_points:
    sc.doc.Objects.AddPoint(point)

# Create a Nurbs curve from the points
nurbs_curve = rg.Curve.CreateInterpolatedCurve(rhino_points, 3)

# Add Nurbs curve to Rhino document for visualization (optional)
sc.doc.Objects.AddCurve(nurbs_curve)

# Create a surface from the Nurbs curve
axis = rg.Line(rg.Point3d(0, 0, 0), rg.Point3d(0, 0, 100))
rev_surface = rg.RevSurface.Create(nurbs_curve, axis)
brep = rev_surface.ToBrep()

# Add the surface to the Rhino document (optional)
if brep.IsValid:
    sc.doc.Objects.AddBrep(brep)

# Output variables
a = rhino_points
b = nurbs_curve
c = brep
# ---------- end distributions_2 ----------
geometry = Geometry(distributions_2.a)  # disabled
geometry_2 = Geometry(distributions_2.b)  # disabled
geometry_3 = Geometry(distributions_2.c)  # disabled
geometry_4 = Geometry(distributions.a)  # disabled
panel_3 = Panel(distributions_2.out)  # disabled
entwine = Entwine(Branch00=geometry, Branch01=geometry_2, Branch02=geometry_3, FlattenInputs=True)  # disabled
distributions_3 = Script(
    num_points=number_slider_8,
    xMin=number_slider_6,
    xMax=number_slider_2,
    yMin=number_slider_7,
    yMax=number_slider_3,
    zMin=number_slider_4,
    zMax=number_slider_5)  # -> out, a; inputs num_points: Int32, xMin: Double, xMax: Double, yMin: Double, yMax: Double, zMin: Double, zMax: Double; disabled
# ---------- distributions_3: Python ----------
import Rhino
import random
import numpy as np
import scriptcontext as sc

# Set the random seed for reproducibility
np.random.seed(0)

# Define the number of points
#num_points = 100

# Generate random coordinates
x = np.random.normal(xMin, xMax, num_points)
y = np.random.normal(yMin, yMax, num_points)
z = np.random.normal(zMin, zMax, num_points)

# Create a list of points
points = [Rhino.Geometry.Point3d(x[i], y[i], z[i]) for i in range(num_points)]

# Add points to the Rhino document
for point in points:
    sc.doc.Objects.AddPoint(point)

# Define the output
a = points
# ---------- end distributions_3 ----------
# Becoming a Data Scientist
# with Python in Grasshopper
# at Wickerson Studios
# 001 Mathematics
# 003 PROBABILITY AND STATISTICS
# 003 distributions
# gpt-4 Text Prompt
# Create a geometric 3D model with
# 
# Mathematics
# 
# PROBABILITY AND STATISTICS
# 
# distributions
# 
# 
# in python 3 code for the python 3 script
# node in grasshopper for Rhino8WIP using the
# 
# Rhino Common API to create some geometry as well.
# 
# Output the parts of the model in different
# variable outputs in the python 3 node in
# grasshopper.
panel_4 = Panel(distributions.out)  # disabled
entwine_2 = Entwine(Branch00=geometry_4, FlattenInputs=True)  # disabled
distributions_4 = Script(num_points=Slider(78, range=0..500), amplitude=Slider(10, range=-10..10))  # -> out, a, b, c; inputs num_points: Int32, amplitude: Double
# ---------- distributions_4: Python ----------
import Rhino
import random
import numpy as np
import scriptcontext as sc
import Rhino.Geometry as rg

# Set random seed for reproducibility
np.random.seed(0)

# Number of points and frequency parameter for trigonometric function
#num_points = 100
frequency = 2 * np.pi / (num_points - 1)  # Angular frequency
#amplitude = 10  # amplitude

# Initialize arrays
x_points = np.zeros(num_points)
y_points = np.zeros(num_points)
z_points = np.zeros(num_points)

# Trigonometric polynomial for x, y, z coordinates
for i in range(num_points):
    theta = i * frequency
    x_points[i] = amplitude * (np.sin(theta) + np.sin(2*theta)/2)
    y_points[i] = amplitude * (np.cos(theta) + np.cos(2*theta)/2)
    z_points[i] = amplitude * (np.sin(theta) * np.cos(theta))

# Create Rhino points
rhino_points = [rg.Point3d(x_points[i], y_points[i], z_points[i]) for i in range(num_points)]

# Add points to Rhino document for visualization (optional)
for point in rhino_points:
    sc.doc.Objects.AddPoint(point)

# Create a Nurbs curve from the points
nurbs_curve = rg.Curve.CreateInterpolatedCurve(rhino_points, 3)

# Add Nurbs curve to Rhino document for visualization (optional)
sc.doc.Objects.AddCurve(nurbs_curve)

# Create a surface from the Nurbs curve
axis = rg.Line(rg.Point3d(0, 0, 0), rg.Point3d(0, 0, 100))
rev_surface = rg.RevSurface.Create(nurbs_curve, axis)
brep = rev_surface.ToBrep()

# Add the surface to the Rhino document (optional)
if brep.IsValid:
    sc.doc.Objects.AddBrep(brep)

# Output variables
a = rhino_points
b = nurbs_curve
c = brep
# ---------- end distributions_4 ----------
geometry_5 = Geometry(distributions_3.a)  # disabled
panel_5 = Panel(entwine)  # disabled
# gpt-4 Initial Response
# Creating a geometric 3D model with probability
# and statistics distributions in Python for
# Grasshopper using the Rhino Common API
# involves several steps. Here is a basic outline of
# the steps you should follow:
# 
# Install and set up the required tools and
# libraries.
# Create the Python script using Rhino Common
# API and any required statistical distributions.
# Run the script in the Grasshopper Python 3
# node.
# Output the parts of the model in different
# variable outputs in the Python 3 node in Grasshopper.
panel_6 = Panel(entwine_2)  # disabled
geometry_6 = Geometry(distributions_4.a)
geometry_7 = Geometry(distributions_4.c)
geometry_8 = Geometry(distributions_4.b)
panel_7 = Panel(distributions_3.out)  # disabled
entwine_3 = Entwine(Branch00=geometry_5, FlattenInputs=True)  # disabled
entwine_4 = Entwine(Branch00=geometry_6, Branch01=geometry_8, Branch02=geometry_7, FlattenInputs=True)
panel_8 = Panel(distributions_4.out)
# gpt-4 Initial Response
# We import the necessary libraries.
# We generate random x, y, and z coordinates
# using the numpy library, following a normal
# distribution.
# We create a list of points using the
# Rhino.Geometry.Point3d class.
# We add the points to the Rhino document using
# the scriptcontext module.
# We define the output a as the list of points.
# To run this script in Grasshopper:
# 
# Open Grasshopper and add a Python 3 node.
# Double-click on the Python 3 node to open the
# Python script editor.
# Paste the script into the script editor.
# Connect the output a to any other Grasshopper
# component to use the generated points.
panel_9 = Panel(entwine_3)  # disabled
panel_10 = Panel(entwine_4)
