# Grasshopper definition C_004_basic_statistics.gh (Grasshopper 1.0.7)
# plug-ins: RhinoCodePluginGH

# ----
# Oscillation Algorithm
# The oscillation algorithm can be use to animate
# any geometry that is driven by a number sliders.
# Simply swap out the number sliders at the
# multiplication node in the oscillation script.
panel = Panel("1")  # disabled
trigger = Trigger(Interval=20, TimerInterval=20, Target=data_recorder)  # disabled
data_recorder = DataRecorder(panel, DataLimit=-10, RecordData=False)  # disabled
number_slider = Slider(49, range=0..1000)  # disabled
list_length = ListLength(List=data_recorder)  # disabled
division = Division(A=list_length, B=number_slider)  # disabled
cosine = Cosine(Value=division)  # disabled
sine = Sine(Value=division)  # disabled
panel_2 = Panel([sine, cosine])  # disabled
multiplication = Multiplication(A=sine)  # disabled
multiplication_2 = Multiplication(A=cosine)  # disabled

# ----
# gpt-4 Text Prompt
# Great, now make the script much more complex model
# with complex trigonometric polynomials and the
# NUMPY python library. Be sure to incorporate
# the previous code logic.
# ensure that this script produces 3d geometry as
# well for Data visualization purposes.
number_slider_2 = Slider(0.006, range=0..0.01)  # disabled
number_slider_3 = Slider(5, range=1..11)  # disabled
number_slider_4 = Slider(27, range=0..100)  # disabled
# PARAMETRIC
number_slider_5 = Slider(17, range=0..100)  # disabled
number_slider_6 = Slider(1.3, range=0..10)  # disabled
# BASIC
basic_statistics = Script()  # -> out, a, b, c, d; disabled
# ---------- basic_statistics: Python ----------
import Rhino
import Rhino.Geometry as rg
import random
import statistics

# Create a list to hold the points
points = []

# Generate random points and collect z-coordinates
z_coordinates = []
for i in range(50):
    x = random.uniform(0, 10)
    y = random.uniform(0, 10)
    z = random.uniform(0, 10)
    points.append(rg.Point3d(x, y, z))
    z_coordinates.append(z)

# Calculate mean, median, and standard deviation of z-coordinates
mean_z = statistics.mean(z_coordinates)
median_z = statistics.median(z_coordinates)
std_dev_z = statistics.stdev(z_coordinates)

# Use the mean to define the radius of the pipe
pipe_radius = mean_z / 1

# Output the geometry and statistics
a = points
b = mean_z
c = median_z
d = std_dev_z
# ---------- end basic_statistics ----------
# ADVANCED
number_slider_7 = Slider(100, range=0..200)
geometry = Geometry(basic_statistics.a)  # disabled
# Becoming a Data Scientist
# with Python in Grasshopper
# at Wickerson Studios
# 001 Mathematics
# 003 PROBABILITY AND STATISTICS
# 004 basic statistics
# gpt-4 Text Prompt
# Create a geometric 3D model with
# 
# Mathematics
# 
# PROBABILITY AND STATISTICS
# 
# basic statistics
# 
# 
# in python 3 code for the python 3 script
# node in grasshopper for Rhino8WIP using the
# 
# Rhino Common API to create some geometry as well.
# 
# Output the parts of the model in different
# variable outputs in the python 3 node in
# grasshopper.
panel_3 = Panel(basic_statistics.out)  # disabled
entwine = Entwine(
    Branch00=geometry,
    Branch01=basic_statistics.b,
    Branch02=basic_statistics.c,
    Branch03=basic_statistics.d,
    FlattenInputs=True)  # disabled
basic_statistics_2 = Script(
    num_points=number_slider_5,
    point_range=number_slider_4,
    input_curve_degree=number_slider_3,
    radius_multiplier=number_slider_6,
    tolerance_value=number_slider_2)  # -> out, a, b, c, d, e, f; inputs num_points: Int32, point_range: Double, input_curve_degree: Int32, radius_multiplier: Double, tolerance_value: Double; disabled
# ---------- basic_statistics_2: Python ----------
import Rhino.Geometry as rg
import random
import statistics

def create_geometry(num_points, point_range, radius_multiplier):
    points = []
    z_coordinates = []
    
    # Generate random points
    for i in range(num_points):
        x = random.uniform(0, point_range)
        y = random.uniform(0, point_range)
        z = random.uniform(0, point_range)
        points.append(rg.Point3d(x, y, z))
        z_coordinates.append(z)
    
    # Calculate basic statistics
    mean_z = statistics.mean(z_coordinates)
    median_z = statistics.median(z_coordinates)
    std_dev_z = statistics.stdev(z_coordinates)
    
    # Create a Nurbs curve from points
    curve = rg.NurbsCurve.Create(False, 3, points)
    
    # Calculate the pipe radius based on statistics
    pipe_radius = mean_z * radius_multiplier
    
    pipe = None
    # Create a pipe around the curve if it's valid
    if curve and curve.IsValid:
        try:
            pipe_result = rg.Brep.CreatePipe(curve, pipe_radius, True, rg.PipeCapMode.Flat)
            if pipe_result:
                pipe = pipe_result[0]
            else:
                print("Failed to create pipe.")
        except Exception as e:
            print("Exception while creating pipe:", e)
    else:
        print("Invalid or null curve")
        
    return points, curve, pipe, mean_z, median_z, std_dev_z

# Parameters from Grasshopper
#num_points = 50 # Slider (Integer)
#point_range = 10.0 # Slider (Float)
#radius_multiplier = 0.1 # Slider (Float)

# Function call and unpacking results
a, b, c, d, e, f = create_geometry(num_points, point_range, radius_multiplier)

# a, b, c, d, e, f will be connected to the output components in Grasshopper
# ---------- end basic_statistics_2 ----------
basic_statistics_3 = Script(
    num_points=number_slider_7,
    point_range=Slider(50, range=0..50),
    radius_multiplier=Slider(3.05, range=0..10),
    frequency=Slider(0.72, range=0.1..1),
    radius=Slider(1.83, range=0..10))  # -> out, a, b, c, d, e, f, g; inputs num_points: Int32, point_range: Double, radius_multiplier: Double, frequency: Double, radius: Double
# ---------- basic_statistics_3: Python ----------
import Rhino.Geometry as rg
import numpy as np
import statistics

def create_complex_geometry(num_points, point_range, radius_multiplier, frequency):
    # Initialize lists
    points = []
    z_coordinates = []
    spheres = []
    brep_spheres = []
    
    # Generate complex trigonometric polynomial points
    for i in np.linspace(0, num_points, num_points):
        theta = i * frequency
        x = np.sin(theta) * np.cos(theta)
        y = np.sin(theta) * np.sin(theta)
        z = np.cos(theta)
        
        # Scale by point_range
        x *= point_range
        y *= point_range
        z *= point_range

        point = rg.Point3d(x, y, z)
        points.append(point)
        z_coordinates.append(z)
        
        # Create color-coded spheres for data visualization
        sphere_geometry = rg.Sphere(point, _radius)
        sphere_brep = rg.Brep.CreateFromSphere(sphere_geometry)
        if sphere_brep:
            brep_spheres.append(sphere_brep)
    
    # Calculate basic statistics
    mean_z = statistics.mean(z_coordinates)
    median_z = statistics.median(z_coordinates)
    std_dev_z = statistics.stdev(z_coordinates)
    
    # Create a Nurbs curve from points
    curve = rg.NurbsCurve.Create(False, 3, points)
    
    # Calculate pipe radius based on mean_z
    pipe_radius = mean_z * radius_multiplier
    
    pipe = None
    # Create a pipe around the curve if it's valid
    if curve and curve.IsValid:
        try:
            pipe_result = rg.Brep.CreatePipe(curve, pipe_radius, True, rg.PipeCapMode.Flat)
            if pipe_result:
                pipe = pipe_result[0]
            else:
                print("Failed to create pipe.")
        except Exception as e:
            print("Exception while creating pipe:", e)
    else:
        print("Invalid or null curve")
        
    return points, curve, pipe, mean_z, median_z, std_dev_z, brep_spheres

# Parameters from Grasshopper
"""
num_points = 100  # Slider (Integer)
point_range = 20.0  # Slider (Float)
radius_multiplier = 0.2  # Slider (Float)
frequency = 0.1  # Slider (Float)
"""

# Function call and unpacking results
a, b, c, d, e, f, g = create_complex_geometry(num_points, point_range, radius_multiplier, frequency)

# a, b, c, d, e, f, g will be connected to the output components in Grasshopper
# ---------- end basic_statistics_3 ----------
# gpt-4 Initial Response
# Creating a 3D geometric model involves several
# steps and might require different libraries in
# Python. The steps include:
# 
# Defining the 3D geometry: You can use the
# RhinoCommon API to define the 3D geometry.
# RhinoCommon is the .NET SDK for Rhino5 /
# Rhino6 from Robert McNeel and Associates. It
# provides the ability to interact with and
# manipulate both the geometry and the
# document structure of Rhino.
# 
# Probability and Statistics: You might use some
# probability and statistics to define the geometry
# or properties of the model. For example, you
# might use a random variable to define the
# location of points, or use statistical analysis to
# analyze the properties of the model.
# 
# Output the parts of the model in different
# variable outputs.
# 
# Certainly! Here is an enhanced example that
# includes statistical analysis on the random
# points generated for the model. We'll use the
# mean, median, and standard deviation to make
# decisions about the geometry.
# 
# For simplicity, let's say we use the mean of the
# z-coordinates to determine the radius of the
# pipe, the median to determine the degree of the
#  curve, and the standard deviation to define the
# density of the points on the curve.
panel_4 = Panel(entwine)  # disabled
geometry_2 = Geometry(basic_statistics_2.a)  # disabled
geometry_3 = Geometry(basic_statistics_3.a)
geometry_4 = Geometry(basic_statistics_3.b)
geometry_5 = Geometry(basic_statistics_3.g)
geometry_6 = Geometry(basic_statistics_3.c)
panel_5 = Panel(basic_statistics_2.out)  # disabled
# gpt-4 Initial Response
# Certainly! Below is an enhanced version of the
# previous script. This version incorporates NumPy
#  for trigonometric polynomial calculations to
# generate more complex 3D geometry. In this
# example, a 3D spiral curve is created based on
# trigonometric functions, and pipes are added to
# it.
# 
# To visualize data, color-coded spheres are
# generated at points along the curve, where the
# color corresponds to the z-coordinate of each
# point. These spheres can serve as data
# visualizations based on the z-value of each
# point in the curve.
entwine_2 = Entwine(
    Branch00=geometry_2,
    Branch01=basic_statistics_2.b,
    Branch02=basic_statistics_2.c,
    Branch03=basic_statistics_2.d,
    Branch04=basic_statistics_2.e,
    Branch05=basic_statistics_2.f,
    FlattenInputs=True)  # disabled
panel_6 = Panel(basic_statistics_3.out)
entwine_3 = Entwine(
    Branch00=geometry_3,
    Branch01=geometry_4,
    Branch02=geometry_6,
    Branch03=basic_statistics_3.d,
    Branch04=basic_statistics_3.e,
    Branch05=basic_statistics_3.f,
    Branch06=geometry_5,
    FlattenInputs=True)
panel_7 = Panel(entwine_2)  # disabled
panel_8 = Panel(entwine_3)
