# Grasshopper definition C_007_variance.gh (Grasshopper 1.0.7)
# plug-ins: RhinoCodePluginGH

# ----
# Oscillation Algorithm
# The oscillation algorithm can be use to animate
# any geometry that is driven by a number sliders.
# Simply swap out the number sliders at the
# multiplication node in the oscillation script.
panel = Panel("1")  # disabled
trigger = Trigger(Interval=20, TimerInterval=20, Target=data_recorder)  # disabled
data_recorder = DataRecorder(panel, DataLimit=-10, RecordData=False)  # disabled
number_slider = Slider(23, range=0..1000)  # disabled
list_length = ListLength(List=data_recorder)  # disabled
division = Division(A=list_length, B=number_slider)  # disabled
cosine = Cosine(Value=division)  # disabled
sine = Sine(Value=division)  # disabled
panel_2 = Panel([sine, cosine])  # disabled

number_slider_2 = Slider(0.39, range=0..1)
multiplication = Multiplication(A=cosine, B=number_slider_2)  # disabled
# PARAMETRIC
number_slider_3 = Slider(0, range=0..100)
number_slider_4 = Slider(0.48, range=0..1)
multiplication_2 = Multiplication(A=sine, B=number_slider_4)  # disabled
# BASIC
# 2nd gpt-4 Text Prompt
# Great, now make the script much more complex model
# with complex trigonometric polynomials and the
# NUMPY python library. Be sure to incorporate the previous code logic.
# ensure that this script produces 3d geometry as
# well for Data visualization purposes.
variance = Script()  # -> out, a, b, c, d; disabled
# ---------- variance: Python ----------
import Rhino
import Rhino.Geometry as rg
import random
import statistics

# Function to generate a cluster of 3D points with a given mean and variance
def generate_point_cluster(mean, variance, n_points):
    points = []
    
    for i in range(n_points):
        # Randomly generating X, Y, Z coordinates based on mean and standard deviation
        x = random.gauss(mean[0], variance[0]**0.5)
        y = random.gauss(mean[1], variance[1]**0.5)
        z = random.gauss(mean[2], variance[2]**0.5)
        
        point = rg.Point3d(x, y, z)
        points.append(point)
        
    return points

# Define the mean and variance for our point cluster
mean = [0, 0, 0]  # X, Y, Z coordinates of the center of the cluster
variance = [10, 10, 10]  # Variance in X, Y, Z directions

# Number of points to generate
n_points = 100

# Generate the point cluster
point_cluster = generate_point_cluster(mean, variance, n_points)

# Output the point cluster to Grasshopper
a = point_cluster

# Calculate the sample variance of the generated point cluster in X, Y, Z directions
x_coords = [pt.X for pt in point_cluster]
y_coords = [pt.Y for pt in point_cluster]
z_coords = [pt.Z for pt in point_cluster]

var_x = statistics.variance(x_coords)
var_y = statistics.variance(y_coords)
var_z = statistics.variance(z_coords)

# Output the calculated variances to Grasshopper
b = var_x
c = var_y
d = var_z
# ---------- end variance ----------
# ADVANCED
variance_2 = Script()  # -> out, a, b, c, d, e; disabled
# ---------- variance_2: Python ----------
import Rhino
import Rhino.Geometry as rg
import random
import statistics
import numpy as np
import math

# Function to generate a cluster of 3D points with a given mean and variance
def generate_point_cluster(mean, variance, n_points):
    points = []
    
    for i in range(n_points):
        # Randomly generating X, Y, Z coordinates based on mean and standard deviation
        x = random.gauss(mean[0], variance[0]**0.5)
        y = random.gauss(mean[1], variance[1]**0.5)
        z = random.gauss(mean[2], variance[2]**0.5)
        
        point = rg.Point3d(x, y, z)
        points.append(point)
        
    return points

# Function to generate a trigonometric polynomial curve based on the point
def generate_curve_from_point(point, t_min, t_max, n_samples):
    t_values = np.linspace(t_min, t_max, n_samples)
    x_coeff = point.X * 0.1
    y_coeff = point.Y * 0.1
    z_coeff = point.Z * 0.1
    
    curve_points = []
    for t in t_values:
        x = x_coeff * np.sin(2 * np.pi * t)
        y = y_coeff * np.cos(3 * np.pi * t)
        z = z_coeff * np.sin(4 * np.pi * t)
        
        curve_point = rg.Point3d(x, y, z)
        curve_points.append(curve_point)
    
    curve = rg.Curve.CreateInterpolatedCurve(curve_points, 3)
    return curve

# Define the mean and variance for our point cluster
mean = [0, 0, 0]  # X, Y, Z coordinates of the center of the cluster
variance = [10, 10, 10]  # Variance in X, Y, Z directions

# Number of points and curve samples to generate
n_points = 100
n_samples = 100

# Generate the point cluster
point_cluster = generate_point_cluster(mean, variance, n_points)

# Output the point cluster to Grasshopper
a = point_cluster

# Generate curves based on the point cluster
curves = []
for point in point_cluster:
    curve = generate_curve_from_point(point, 0, 1, n_samples)
    curves.append(curve)

# Output the curves to Grasshopper
b = curves

# Calculate the sample variance of the generated point cluster in X, Y, Z directions
x_coords = [pt.X for pt in point_cluster]
y_coords = [pt.Y for pt in point_cluster]
z_coords = [pt.Z for pt in point_cluster]

var_x = statistics.variance(x_coords)
var_y = statistics.variance(y_coords)
var_z = statistics.variance(z_coords)

# Output the calculated variances to Grasshopper
c = var_x
d = var_y
e = var_z
# ---------- end variance_2 ----------
geometry = Geometry(variance.a)  # disabled
geometry_2 = Geometry(variance_2.a)  # disabled
geometry_3 = Geometry(variance_2.b)  # disabled
# gpt-4 Text Prompt
# Create a geometric 3D model with
# 
# Mathematics
# 
# PROBABILITY AND STATISTICS
# 
# variance: In probability theory and statistics,
# variance is the squared deviation from the mean
#  of a random variable. The variance is also often
#  defined as the square of the standard
# deviation. Variance is a measure of dispersion,
# meaning it is a measure of how far a set of
# numbers is spread out from their average value.
# It is the second central moment of a distribution,
#  and the covariance of the random variable with
#  itself, and it is often represented by
# 
# 2
# \sigma ^{2},
# 2
# s^{2},
# Var
# 
# (
# )
# \operatorname {Var} (X),
# {\displaystyle \mathbb {V} (X)}
# 
# 
# in python 3 code for the python 3 script
# node in grasshopper for Rhino8WIP using the
# 
# Rhino Common API to create some geometry as well.
# 
# Output the parts of the model in different
# variable outputs in the python 3 node in
# grasshopper.
panel_3 = Panel(variance.out)  # disabled
panel_4 = Panel(variance_2.out)  # disabled
variance_3 = Script(
    mean=[number_slider_3, Slider(0, range=0..100), Slider(0, range=0..100)],
    variance=[Slider(10, range=0..10), Slider(10, range=0..10), Slider(10, range=0..10)],
    n_points=Slider(32, range=0..100),
    n_samples=Slider(18, range=0..100),
    t_min=number_slider_4,
    t_max=number_slider_2,
    scale_factor=Slider(0.43, range=0..1))  # -> out, a, b, c, d, e; inputs mean: list of Double, variance: list of Double, n_points: Int32, n_samples: Int32, t_min: Double, t_max: Double, scale_factor: Double
# ---------- variance_3: Python ----------
import Rhino
import Rhino.Geometry as rg
import random
import statistics
import numpy as np
import math

# Function to generate a cluster of 3D points with a given mean and variance
def generate_point_cluster(mean, variance, n_points):
    points = []
    
    for i in range(n_points):
        x = random.gauss(mean[0], variance[0]**0.5)
        y = random.gauss(mean[1], variance[1]**0.5)
        z = random.gauss(mean[2], variance[2]**0.5)
        
        point = rg.Point3d(x, y, z)
        points.append(point)
        
    return points

# Function to generate a trigonometric polynomial curve based on a point
def generate_curve_from_point(point, t_min, t_max, n_samples, scale_factor):
    t_values = np.linspace(t_min, t_max, n_samples)
    x_coeff = point.X * scale_factor
    y_coeff = point.Y * scale_factor
    z_coeff = point.Z * scale_factor
    
    curve_points = []
    for t in t_values:
        x = x_coeff * np.sin(2 * np.pi * t)
        y = y_coeff * np.cos(3 * np.pi * t)
        z = z_coeff * np.sin(4 * np.pi * t)
        
        curve_point = rg.Point3d(x, y, z)
        curve_points.append(curve_point)
    
    curve = rg.Curve.CreateInterpolatedCurve(curve_points, 3)
    return curve

# Input Parameters
"""
mean = [0, 0, 0]  # Recommended: [0, 0, 0]
variance = [10, 10, 10]  # Recommended: [10, 10, 10]
n_points = 100  # Recommended: 100
n_samples = 100  # Recommended: 100
t_min = 0  # Recommended: 0
t_max = 1  # Recommended: 1
scale_factor = 0.1  # Recommended: 0.1
"""

# Generate the point cluster
point_cluster = generate_point_cluster(mean, variance, n_points)

# Output the point cluster to Grasshopper
a = point_cluster

# Generate curves based on the point cluster
curves = []
for point in point_cluster:
    curve = generate_curve_from_point(point, t_min, t_max, n_samples, scale_factor)
    curves.append(curve)

# Output the curves to Grasshopper
b = curves

# Calculate the sample variance of the generated point cluster in X, Y, Z directions
x_coords = [pt.X for pt in point_cluster]
y_coords = [pt.Y for pt in point_cluster]
z_coords = [pt.Z for pt in point_cluster]

var_x = statistics.variance(x_coords)
var_y = statistics.variance(y_coords)
var_z = statistics.variance(z_coords)

# Output the calculated variances to Grasshopper
c = var_x
d = var_y
e = var_z
# ---------- end variance_3 ----------
entwine = Entwine(Branch00=geometry, Branch01=variance.b, Branch02=variance.c, Branch03=variance.d, FlattenInputs=True)  # disabled
entwine_2 = Entwine(
    Branch00=geometry_2,
    Branch01=geometry_3,
    Branch02=variance_2.c,
    Branch03=variance_2.d,
    Branch04=variance_2.e,
    FlattenInputs=True)  # disabled
# Becoming a Data Scientist
# with Python in Grasshopper
# at Wickerson Studios
# 001 Mathematics
# 001 PROPABILITY AND STATISTICS
# 009 variance
# gpt-4 Initial Response
# Creating a geometric 3D model based on
# variance involves a couple of steps. First, you
# need to decide what aspect of the geometry will
# be influenced by the statistical measure of
# variance. Second, you will have to write code to
# generate that geometry using Python and the
# Rhino Common API.
# 
# Below is a simplified example that shows how
# you can create a cluster of 3D points where the
# spread of the points is controlled by the variance
#  of a set of random numbers. The Python script
# can be used in a Python 3 node in Grasshopper
# for Rhino 8 WIP.
panel_5 = Panel(entwine)  # disabled
# gpt-4 Initial Response
# Certainly! Below is a Python 3 script for
# Grasshopper that creates a more complex 3D
# geometry based on trigonometric polynomials
# and incorporates variance as in the previous
# example. I also added the use of the numpy
# library to help with calculations. This script
# produces a collection of sinusoidal curves
# whose properties are determined by the point
# cluster generated in the first part of the script.
panel_6 = Panel(entwine_2)  # disabled
geometry_4 = Geometry(variance_3.a)
geometry_5 = Geometry(variance_3.b)
panel_7 = Panel(variance_3.out)
entwine_3 = Entwine(
    Branch00=geometry_4,
    Branch01=geometry_5,
    Branch02=variance_3.c,
    Branch03=variance_3.d,
    Branch04=variance_3.e,
    FlattenInputs=True)
panel_8 = Panel(entwine_3)
