# Grasshopper definition C_011_kurtosis.gh (Grasshopper 1.0.7)
# plug-ins: RhinoCodePluginGH

number_slider = Slider(-1, range=-1..1)
number_slider_2 = Slider(-1, range=-1..1)
number_slider_3 = Slider(1, range=-1..1)
number_slider_4 = Slider(1, range=-1..1)

# ----
# Oscillation Algorithm
# The oscillation algorithm can be use to animate
# any geometry that is driven by a number sliders.
# Simply swap out the number sliders at the
# multiplication node in the oscillation script.
panel = Panel("1")  # disabled
trigger = Trigger(Interval=20, TimerInterval=20, Target=data_recorder)  # disabled
data_recorder = DataRecorder(panel, DataLimit=-10, RecordData=False)  # disabled
number_slider_5 = Slider(23, range=0..1000)  # disabled
list_length = ListLength(List=data_recorder)  # disabled
division = Division(A=list_length, B=number_slider_5)  # disabled
cosine = Cosine(Value=division)  # disabled
sine = Sine(Value=division)  # disabled
panel_2 = Panel([sine, cosine])  # disabled
multiplication = Multiplication(A=cosine, B=number_slider_2)  # disabled
multiplication_2 = Multiplication(A=sine, B=number_slider)  # disabled
multiplication_3 = Multiplication(A=cosine, B=number_slider_4)  # disabled
multiplication_4 = Multiplication(A=sine, B=number_slider_3)  # disabled

# ----
# PARAMETRIC
kurtosis = Script()  # -> out, output_points, output_spheres, output_kurtosis; disabled
# ---------- kurtosis: Python ----------
import Rhino.Geometry as rg
import numpy as np
import math

# Function to calculate kurtosis
def kurtosis(data):
    n = len(data)
    mean = np.mean(data)
    variance = np.var(data)
    std_dev = np.sqrt(variance)
    
    kurtosis_value = np.mean((data - mean)**4) / (std_dev**4) - 3
    return kurtosis_value

# Generate trigonometric polynomial points
num_points = 100
theta = np.linspace(0, 2*np.pi, num_points)
radius_values = 5 + 2*np.sin(3*theta) + np.cos(5*theta)

# Calculate kurtosis of radius_values
kurtosis_value = kurtosis(radius_values)

# Create 3D points and spheres
points = []
spheres = []
for i, r in enumerate(radius_values):
    x = r * np.cos(theta[i])
    y = r * np.sin(theta[i])
    z = 5 * np.sin(0.1 * theta[i])
    
    point = rg.Point3d(x, y, z)
    sphere = rg.Sphere(point, r)
    
    points.append(point)
    spheres.append(sphere.ToNurbsSurface())  # Convert to NurbsSurface for compatibility

# Set Outputs
output_points = points
output_spheres = spheres
output_kurtosis = kurtosis_value
# ---------- end kurtosis ----------
# BASIC
# 2nd gpt-4 Text Prompt
# Great, now make the script much more complex model
# with complex trigonometric polynomials and the
# NUMPY python library. Be sure to incorporate the previous code logic.
# ensure that this script produces 3d geometry as
# well for Data visualization purposes.
kurtosis_2 = Script()  # -> out, output_point, output_sphere, output_kurtosis; disabled
# ---------- kurtosis_2: Python ----------
import Rhino.Geometry as rg
import math

# Function to calculate kurtosis
def kurtosis(data):
    n = len(data)
    mean = sum(data) / n
    variance = sum((xi - mean) ** 2 for xi in data) / n
    std_dev = math.sqrt(variance)
    
    kurtosis_value = sum((xi - mean) ** 4 for xi in data) / (n * (std_dev ** 4)) - 3
    return kurtosis_value

# Create point at (1, 1, 1)
point = rg.Point3d(1.0, 1.0, 1.0)

# Create a sphere centered at the point with radius 5
sphere = rg.Sphere(point, 5.0)

# Generate some data for calculating kurtosis
data = [1.0, 2.3, 3.4, 4.5, 3.4, 2.3, 1.0]

# Calculate kurtosis
kurtosis_value = kurtosis(data)

# Set Outputs
output_point = point
output_sphere = sphere.ToNurbsSurface()
output_kurtosis = kurtosis_value
# ---------- end kurtosis_2 ----------
geometry = Geometry(kurtosis.output_points)  # disabled
geometry_2 = Geometry(kurtosis_2.output_point)  # disabled
geometry_3 = Geometry(kurtosis.output_spheres)  # disabled
geometry_4 = Geometry(kurtosis_2.output_sphere)  # disabled
# ADVANCED
panel_3 = Panel(kurtosis.out)  # disabled
# Becoming a Data Scientist
# with Python in Grasshopper
# at Wickerson Studios
# 001 Mathematics
# 001 PROBABILITY AND STATISTICS
# 011_kurtosis
# gpt-4 Text Prompt
# Create a geometric 3D model with
# 
# Mathematics
# 
# PROBABILITY AND STATISTICS
# 
# kurtosis
# 
# 
# in python 3 code for the python 3 script
# node in grasshopper for Rhino8WIP using the
# 
# Rhino Common API to create some geometry as well.
# 
# Output the parts of the model in different
# variable outputs in the python 3 node in
# grasshopper.
panel_4 = Panel(kurtosis_2.out)  # disabled
entwine = Entwine(Branch00=geometry, Branch01=geometry_3, Branch03=kurtosis.output_kurtosis, FlattenInputs=True)  # disabled
entwine_2 = Entwine(Branch00=geometry_2, Branch01=geometry_4, Branch03=kurtosis_2.output_kurtosis, FlattenInputs=True)  # disabled
kurtosis_3 = Script(
    num_points=Slider(13, range=0..100),
    freq1=number_slider,
    freq2=number_slider_2,
    amp1=number_slider_3,
    amp2=number_slider_4)  # -> out, output_points, output_spheres, output_kurtosis; inputs num_points: Int32, freq1: Double, freq2: Double, amp1: Double, amp2: Double
# ---------- kurtosis_3: Python ----------
import Rhino.Geometry as rg
import numpy as np
import math

# Function to calculate kurtosis
def kurtosis(data):
    n = len(data)
    mean = np.mean(data)
    variance = np.var(data)
    std_dev = np.sqrt(variance)
    
    kurtosis_value = np.mean((data - mean)**4) / (std_dev**4) - 3
    return kurtosis_value

# Parameters (set these up as input parameters in your Grasshopper component)
# num_points: int (Number of points, suggested default=100)
# freq1, freq2: float (Frequency for sin and cos, suggested default=3 and 5)
# amp1, amp2: float (Amplitude for sin and cos, suggested default=2 and 1)

# Generate trigonometric polynomial points
theta = np.linspace(0, 2 * np.pi, num_points)
radius_values = 5 + amp1 * np.sin(freq1 * theta) + amp2 * np.cos(freq2 * theta)

# Calculate kurtosis of radius_values
kurtosis_value = kurtosis(radius_values)

# Create 3D points and spheres, then convert them to Breps
points = []
spheres = []
for i, r in enumerate(radius_values):
    x = r * np.cos(theta[i])
    y = r * np.sin(theta[i])
    z = 5 * np.sin(0.1 * theta[i])
    
    point = rg.Point3d(x, y, z)
    sphere = rg.Sphere(point, r)
    brep = sphere.ToBrep()
    
    points.append(point)
    spheres.append(brep)

# Set Outputs (set these up as output parameters in your Grasshopper component)
output_points = points
output_spheres = spheres
output_kurtosis = kurtosis_value
# ---------- end kurtosis_3 ----------
# gpt-4 Initial Response
# Creating a geometric 3D model in Python
# involves using some specific libraries such as
# numpy for numerical operations and rhino3dm
# to interact with the Rhino Common API.
# However, it is not clear how you want to
# incorporate 'kurtosis', a statistical measure, into a geometric 3D model.
panel_5 = Panel(entwine_2)  # disabled
# gpt-4 Initial Response
# Certainly! Below is an example Python script that
# should be placed within a Python component in
# Grasshopper for Rhino. This script builds upon the
# previous logic to include trigonometric polynomials,
# complex kurtosis calculations, and 3D geometry
# creation using Numpy.
# 
# This script will create multiple spheres whose radius is
# determined by a trigonometric polynomial function. The
#  kurtosis of each set of radii will also be calculated and
# outputted.
panel_6 = Panel(entwine)  # disabled
geometry_5 = Geometry(kurtosis_3.output_points)
geometry_6 = Geometry(kurtosis_3.output_spheres)
panel_7 = Panel(kurtosis_3.out)
entwine_3 = Entwine(Branch00=geometry_5, Branch01=geometry_6, Branch02=kurtosis_3.output_kurtosis, FlattenInputs=True)
panel_8 = Panel(entwine_3)
